# Grasshopper definition CEM_Zurich_Bridge_R7_no_install.gh (Grasshopper 1.0.7)

generate_random_input = GhPythonScript()  # -> cable_center_deviation_force, deck_center_deviation_force, hangar_force, deck_deviation_force, cable_deviation_force, tower_force, tower_brace_force, deck_rise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
# ---------- generate_random_input: Python ----------
import random
cable_center_deviation_force = random.uniform(10.0, 20.0)
hangar_force = random.uniform(0.95, 0.98)
cable_deviation_force = random.uniform(-0.1, 0.2)
deck_deviation_force = random.uniform(-0.2, 0.1)
tower_force = random.uniform(-30.0, -20.0)
tower_brace_force = random.uniform(-5.0, 0.0)
deck_rise = random.uniform(2.0, 6.0)
cable_deck_midspan_distance = random.uniform(0.1, 2.0)
tower_base_x_offset = random.uniform(0.0, 20.0)
tower_base_y_offset = random.uniform(0.0, 5.0)
twist_offset = 0
deck_center_deviation_force = random.uniform(-3.0, -1.5)
# ---------- end generate_random_input ----------

# ---- group: create topology diagram / define trail edges
towers = Curve([<curve referenced from the Rhino model> x4])
supporting_spans = Curve([<curve referenced from the Rhino model> x32])
deck = Curve([<curve referenced from the Rhino model> x28])
cem_trail = GhPythonScript(trailEdge=supporting_spans)  # -> T; inputs trailEdge: list of Curve, trailLen: list
# ---------- cem_trail: Python ----------
"""
Defines new trail edges from inputs
    Inputs:
        trailEdge: (curves) The curves (segments) that define the trail members in the topological diagram
        trailLen: (float) The lenghts of the trail members [m] (tension-positive, compression-negative)
    Outputs:
        T: (trailObject) The constructed trail object
    Remarks:
        This generates a new instance of a trail object
"""

import Rhino


class Trail(object):
    def __repr__(self):
        return self.ToString()
        
    def __str__(self):
        return self.ToString()
        
    def ToString(self):
        if trailEdge:
            return "Trail Member"



if trailEdge:
    T = Trail()
    T.geom = []
    T.len = []
    
    if trailLen:
        if len(trailEdge) == len(trailLen):
            trailLenC = []
            for i in range(len(trailEdge)):
                trailLenC.append( trailLen[i] )
            T.geom = trailEdge
            T.len = trailLenC
        elif len(trailLen) == 1:
            trailLenC = []
            for i in range(len(trailEdge)):
                trailLenC.append( trailLen[0] )
            T.geom = trailEdge
            T.len = trailLenC
        else:
            trailLenC = []
            for i in range(len(trailEdge)):
                trailLenC.append( 1 )
            T.geom = trailEdge
            T.len = trailLenC
    else:
        trailLenC = []
        for i in range(len(trailEdge)):
            trailLenC.append( 1 )
        T.geom = trailEdge
        T.len = trailLenC
# ---------- end cem_trail ----------
cem_trail_2 = GhPythonScript(trailEdge=deck)  # -> T; inputs trailEdge: list of Curve, trailLen: list; same code as cem_trail
cem_trail_3 = GhPythonScript(trailEdge=towers)  # -> T; inputs trailEdge: list of Curve, trailLen: list; same code as cem_trail
merge = Merge(Data1=cem_trail, Data2=cem_trail_2, Data3=cem_trail_3)

# ---- group: create topology diagram / define support points
support_poirnts = Point([<point referenced from the Rhino model> x12])
cem_support = GhPythonScript(support=support_poirnts)  # -> S; inputs support: list of Point3d
# ---------- cem_support: Python ----------
"""
Defines a new support object from inputs
    Inputs:
        support: (points) The support points in the topological diagram
    Outputs:
        S: (supportObject) The constructed support object 
    Remarks:
        This generates a new instance of the support object
"""


class Support(object):
    def __repr__(self):
        return self.ToString()
        
    def __str__(self):
        return self.ToString()
        
    def ToString(self):
        if support:
            return "Support"


if support:
    S = Support()
    S.geom = support
# ---------- end cem_support ----------

# ---- group: create topology diagram / set external loads
deck_points = Point([<point referenced from the Rhino model> x28])
panel = Panel("0")
panel_2 = Panel("0")
panel_3 = Panel("-1")
cem_load = GhPythonScript(pointLoad=deck_points, loadMagnX=panel, loadMagnY=panel_2, loadMagnZ=panel_3)  # -> L; inputs pointLoad: list of Point3d, loadMagnX: list, loadMagnY: list, loadMagnZ: list
# ---------- cem_load: Python ----------
"""
Defines a new point load object from inputs
    Inputs:
        pointLoad: (point) The vertices that define the point loads in the topological diagram
        loadMagnX: (float) The magnitude of the point load in x-direction [kN]
        loadMagnY: (float) The magnitude of the point load in y-direction [kN]
        loadMagnZ: (float) The magnitude of the point load in z-direction [kN]
    Outputs:
        L: (pointLoadObject) The constructed point load object
    Remarks:
        This generates a new instance of the constructed point load object 
"""



import Rhino


class Load(object):
    def __repr__(self):
        return self.ToString()
        
    def __str__(self):
        return self.ToString()
        
    def ToString(self):
        if pointLoad:
            return "Point Load"
        else:
            return "No external Load"



if pointLoad:
    L = Load()
    L.geom = []
    L.magn = []
    
    if not loadMagnX: loadMagnX.append(0.0)
    if not loadMagnY: loadMagnY.append(0.0)
    if not loadMagnZ: loadMagnZ.append(0.0)
    
    loadMagn = []
    if len(loadMagnX) == len(loadMagnY) == len(loadMagnZ):
        if len(pointLoad) == len(loadMagnX):
            for i in range(len(pointLoad)):
                loadMagn.append( (loadMagnX[i],loadMagnY[i],loadMagnZ[i]) )
            L.geom = pointLoad
            L.magn = loadMagn
        elif len(loadMagnX) == 1:
            for i in range(len(pointLoad)):
                loadMagn.append( (loadMagnX[0],loadMagnY[0],loadMagnZ[0]) )
            L.geom = pointLoad
            L.magn = loadMagn
        else:
            for i in range(len(pointLoad)):
                loadMagn.append( 0,0,0 )
            L.geom = pointLoad
            L.magn = loadMagn
    else:
        for i in range(len(pointLoad)):
            loadMagn.append( 0,0,0 )
        L.geom = pointLoad
        L.magn = loadMagn
# ---------- end cem_load ----------

# ---- group: input parameter selection
panel_4 = Panel("240731_data_00_CEM.csv")
panel_5 = Panel("0")
trigger = Trigger(Interval=10, TimerInterval=10, Target=generate_random_input)  # disabled
list = ValueList({"Slider input": "0", "Random input": "1", "Data input": "2"}, selected="Slider input")
merge_2 = Merge(
    Data1=generate_random_input.cable_center_deviation_force,
    Data2=generate_random_input.deck_center_deviation_force,
    Data3=generate_random_input.hangar_force,
    Data4=generate_random_input.deck_deviation_force,
    Data5=generate_random_input.cable_deviation_force,
    Data6=generate_random_input.tower_force,
    Data7=generate_random_input.tower_brace_force,
    Data8=generate_random_input.deck_rise,
    Data9=generate_random_input.cable_deck_midspan_distance,
    Data10=generate_random_input.tower_base_x_offset,
    Data11=generate_random_input.tower_base_y_offset,
    Data12=generate_random_input.twist_offset)

# ----
load_input = GhPythonScript(index=panel_5, file_name=panel_4)  # -> cable_center_deviation_force, deck_center_deviation_force, hangar_force, deck_deviation_force, cable_deviation_force, tower_force, tower_brace_force, deck_rise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
# ---------- load_input: Python ----------
import os
import csv
import rhinoscriptsyntax as rs

with open(os.path.join(rs.DocumentPath(), 'Data' , file_name)) as csvfile:
    reader = csv.reader(csvfile, delimiter=',', quoting=csv.QUOTE_NONNUMERIC)
    data = [row for row in reader if row != []]
    (
        cable_center_deviation_force, deck_center_deviation_force, hangar_force, deck_deviation_force,
        cable_deviation_force, tower_force, tower_brace_force, deck_rise, cable_deck_midspan_distance,
        tower_base_x_offset, tower_base_y_offset, twist_offset
    ) = data[int(index)][0:12]
    print(cable_center_deviation_force)
# ---------- end load_input ----------

# ---- group: input parameter selection (continued)
merge_3 = Merge(
    Data1=load_input.cable_center_deviation_force,
    Data2=load_input.deck_center_deviation_force,
    Data3=load_input.hangar_force,
    Data4=load_input.deck_deviation_force,
    Data5=load_input.cable_deviation_force,
    Data6=load_input.tower_force,
    Data7=load_input.tower_brace_force,
    Data8=load_input.deck_rise,
    Data9=load_input.cable_deck_midspan_distance,
    Data10=load_input.tower_base_x_offset,
    Data11=load_input.tower_base_y_offset,
    Data12=load_input.twist_offset)

# ---- group: create topology diagram / define deviation edges
deck_deviation_force = Slider(-0.003, range=-0.2..0.1)
hangar_force = Curve([<curve referenced from the Rhino model> x28])
tower_force = Slider(-24.946, range=-25..-15)
cable_center_deviations = Curve([<curve referenced from the Rhino model> x2])
cable_center_deviation_force = Slider(20, range=10..20)
deck_center_deviation_force = Slider(-2.177, range=-3..-1.5)
deck_deviations = Curve([<curve referenced from the Rhino model> x14])
cable_deviations = Curve([<curve referenced from the Rhino model> x14])
tower_deviations = Curve([<curve referenced from the Rhino model> x4])
tower_braces = Curve([<curve referenced from the Rhino model> x2])
hangar_force_2 = Slider(0.963, range=0.95..0.98)
tower_brace_force = Slider(-2.646, range=-5..0)
deck_center_deviations = Curve([<curve referenced from the Rhino model> x2])
cable_deviation_force = Slider(0.008, range=-0.1..0.2)
filter = StreamFilter(
    Gate=list,
    Stream0=cable_center_deviation_force,
    Stream1=generate_random_input.cable_center_deviation_force,
    Stream2=load_input.cable_center_deviation_force)
filter_2 = StreamFilter(
    Gate=list,
    Stream0=deck_center_deviation_force,
    Stream1=generate_random_input.deck_center_deviation_force,
    Stream2=load_input.deck_center_deviation_force)
filter_3 = StreamFilter(Gate=list, Stream0=hangar_force_2, Stream1=generate_random_input.hangar_force, Stream2=load_input.hangar_force)
filter_4 = StreamFilter(
    Gate=list,
    Stream0=deck_deviation_force,
    Stream1=generate_random_input.deck_deviation_force,
    Stream2=load_input.deck_deviation_force)
filter_5 = StreamFilter(
    Gate=list,
    Stream0=cable_deviation_force,
    Stream1=generate_random_input.cable_deviation_force,
    Stream2=load_input.cable_deviation_force)
filter_6 = StreamFilter(Gate=list, Stream0=tower_force, Stream1=generate_random_input.tower_force, Stream2=load_input.tower_force)
filter_7 = StreamFilter(
    Gate=list,
    Stream0=tower_brace_force,
    Stream1=generate_random_input.tower_brace_force,
    Stream2=load_input.tower_brace_force)
cem_deviation = GhPythonScript(deviationEdge=cable_center_deviations, deviationMagn=filter)  # -> D; inputs deviationEdge: list of Curve, deviationMagn: list
# ---------- cem_deviation: Python ----------
"""
Defines a new deviation object from inputs
    Inputs:
        deviationEdge: (curves) The curves that define the deviation members in the topological diagram
        deviationMagn: (float) The force magnitudes of the deviation members [kN] (tension-positive, compression-negative) 
    Outputs:
        D: (deviationObject) The constructed deviation object
    Remarks:
        This generates a new instance of the deviation object
"""

class Deviation(object):
    def __repr__(self):
        return self.ToString()
        
    def __str__(self):
        return self.ToString()
        
    def ToString(self):
        if deviationEdge:
            return "Deviation Member"



if deviationEdge:
    D = Deviation()
    D.geom = []
    D.magn = []
    
    if deviationMagn:
        if len(deviationEdge) == len(deviationMagn):
            deviationMagnC = []
            for i in range(len(deviationEdge)):
                deviationMagnC.append( deviationMagn[i] )
            D.geom = deviationEdge
            D.magn = deviationMagnC
        elif len(deviationMagn) == 1:
            deviationMagnC = []
            for i in range(len(deviationEdge)):
                deviationMagnC.append( deviationMagn[0] )
            D.geom = deviationEdge
            D.magn = deviationMagnC
        else:
            deviationMagnC = []
            for i in range(len(deviationEdge)):
                deviationMagnC.append( 1 )
            D.geom = deviationEdge
            D.magn = deviationMagnC
    else:
        deviationMagnC = []
        for i in range(len(deviationEdge)):
            deviationMagnC.append( 1 )
        D.geom = deviationEdge
        D.magn = deviationMagnC
# ---------- end cem_deviation ----------
cem_deviation_2 = GhPythonScript(deviationEdge=deck_center_deviations, deviationMagn=filter_2)  # -> D; inputs deviationEdge: list of Curve, deviationMagn: list; same code as cem_deviation
cem_deviation_3 = GhPythonScript(deviationEdge=hangar_force, deviationMagn=filter_3)  # -> D; inputs deviationEdge: list of Curve, deviationMagn: list; same code as cem_deviation
cem_deviation_4 = GhPythonScript(deviationEdge=deck_deviations, deviationMagn=filter_4)  # -> D; inputs deviationEdge: list of Curve, deviationMagn: list; same code as cem_deviation
cem_deviation_5 = GhPythonScript(deviationEdge=cable_deviations, deviationMagn=filter_5)  # -> D; inputs deviationEdge: list of Curve, deviationMagn: list; same code as cem_deviation
cem_deviation_6 = GhPythonScript(deviationEdge=tower_deviations, deviationMagn=filter_6)  # -> D; inputs deviationEdge: list of Curve, deviationMagn: list; same code as cem_deviation
cem_deviation_7 = GhPythonScript(deviationEdge=tower_braces, deviationMagn=filter_7)  # -> D; inputs deviationEdge: list of Curve, deviationMagn: list; same code as cem_deviation
merge_4 = Merge(
    Data1=cem_deviation,
    Data2=cem_deviation_2,
    Data3=cem_deviation_3,
    Data4=cem_deviation_4,
    Data5=cem_deviation_5,
    Data6=cem_deviation_6,
    Data7=cem_deviation_7)

# ---- group: create topology diagram
cem_build_topology = PythonScript(T=merge, L=cem_load, D=merge_4, S=cem_support)  # -> TP; inputs T: list, L: list, D: list, S: list
# ---------- cem_build_topology: Python ----------
"""
Defines a new topological diagram from inputs
    Inputs:
        T: (trailObjects) Trail members in the topological diagram 
        L: (pointLoadObjects) Point Loads in the topological diagram 
        D: (deviationObjects) Deviation members in the topological diagram 
        S: (supportObjects) Supports in the topological diagram
    Outputs:
        TP: (topological diagram) The constructed topological diagram (empty topology on error)
    Remarks:
        This generates a new instance of the topological diagram
"""

__author__    = ['Patrick Ole Ohlbrock','Pierluigi D''Acunto' ]
__copyright__ = 'Copyright 2019 - Chair of Structural Design, ETH Zurich'
__license__   = 'MIT License'
__email__     = 'ohlbrock@arch.ethz.ch'
__version__   = "1.80"

"""
If you use the CEM library in a project, please refer to the GitHub repository: 

@Misc{cem2019,
author = {Ohlbrock, Patrick Ole and D'Acunto, Pierluigi},
title = {{CEM: Combinatorial Equilibrium Modeling}},
year = {2019},
note = {Release 1.80},
url = { http://github.com/OleOhlbrock/CEM },
}

"""




import System.Drawing.Color
import System.Guid
import Rhino
db0_T = 0.001

class topology(object):
    def __repr__(self):
        return self.ToString()
        
    def __str__(self):
        return self.ToString()
        
    def ToString(self):
        if trailMembers and trailMembersID:
            if len(trailMembers) == len(trailMembersID):
                str0_Description = ""
                if hasattr(self, "str1_StructuralBehaviourOut") or hasattr(self, "db1_StructuralBehaviourOut")  and pt1_NodeOut and int2_Trail:
                    str0_Description += "Topological Diagram\n\nvertices: " + str(len(pt1_NodeOut)) + "\ntrail members: " + str(len(int2_Trail)) 
                    if int2_Deviation1:
                        str0_Description += "\ndirect deviation members: " + str(len(int2_Deviation1))
                        if str2_Deviation2:
                            str0_Description += "\nindirect deviation members: " + str(len(str2_Deviation2))
                    return str0_Description
                else:
                    return "Empty topology"
            else:
                return "Empty topology"
        else:
            return "Empty topology"


def ListListToList(xx2_Data):
    xx1_DataOut = []
    for xx1_Data in xx2_Data:
        xx1_DataOut.extend(xx1_Data)
    return xx1_DataOut


TP = topology()


externalForces = []
externalForcesID = []
if L:
    for l in L:
        if l:
            externalForces.extend(l.geom)
            externalForcesID.extend(l.magn)


trailMembers = []
trailMembersID = []
if T:
    for t in T:
        if t:
            trailMembers.extend(t.geom)
            trailMembersID.extend(t.len)


deviationMembers = []
deviationMembersID = []
if D:
    for d in D:
        if d:
            deviationMembers.extend(d.geom)
            deviationMembersID.extend(d.magn)

supports = []
if S:
    for s in S:
        if s:
            supports.extend(s.geom)



if trailMembers and trailMembersID:
    if len(trailMembers) == len(trailMembersID) and len(deviationMembers) == len(deviationMembersID) and len(externalForces) == len(externalForcesID):

        # Create List of Nodes and trailMembers' Connectivity
        pt1_Node = []
        int2_Trail = []
        int2_Deviation = []
        int2_ExtForce = []
        
        pt1_Node.append(trailMembers[0].PointAtStart)
        
        # Nodes and Egdes from trailMembers
        for crv0_Trail in trailMembers:
            int1_Trail = []
            pt0_Start = crv0_Trail.PointAtStart
            bl0_Check = False
            for i in xrange(len(pt1_Node)):
                if abs(pt0_Start.X - pt1_Node[i].X) < db0_T and abs(pt0_Start.Y - pt1_Node[i].Y) < db0_T and abs(pt0_Start.Z - pt1_Node[i].Z) < db0_T:
                    int1_Trail.append(i)
                    bl0_Check = True
                    break
            if bl0_Check == False:
                pt1_Node.append(pt0_Start)
                int1_Trail.append(len(pt1_Node)-1)
            pt0_End = crv0_Trail.PointAtEnd
            bl0_Check = False
            for i in xrange(len(pt1_Node)):
                if abs(pt0_End.X - pt1_Node[i].X) < db0_T and abs(pt0_End.Y - pt1_Node[i].Y) < db0_T and abs(pt0_End.Z - pt1_Node[i].Z) < db0_T:
                    int1_Trail.append(i)
                    bl0_Check = True
                    break
            if bl0_Check == False:
                pt1_Node.append(pt0_End)
                int1_Trail.append(len(pt1_Node)-1)
            int2_Trail.append(int1_Trail)
        

        # Deviation
        crv1_DeviationClean = []
        id1_DeviationClean = []
        for k in xrange(len(deviationMembers)):
            pt0_StartDeviation = deviationMembers[k].PointAtStart
            pt0_EndDeviation = deviationMembers[k].PointAtEnd
            for i in xrange(len(pt1_Node)):
                if abs(pt0_StartDeviation.X - pt1_Node[i].X) < db0_T and abs(pt0_StartDeviation.Y - pt1_Node[i].Y) < db0_T and abs(pt0_StartDeviation.Z - pt1_Node[i].Z) < db0_T:
                    for j in xrange(len(pt1_Node)):
                        if abs(pt0_EndDeviation.X - pt1_Node[j].X) < db0_T and abs(pt0_EndDeviation.Y - pt1_Node[j].Y) < db0_T and abs(pt0_EndDeviation.Z - pt1_Node[j].Z) < db0_T:
                            crv1_DeviationClean.append(deviationMembers[k])
                            id1_DeviationClean.append(deviationMembersID[k])
                            int1_Deviation = []
                            int1_Deviation.append(i)
                            int1_Deviation.append(j)
                            int2_Deviation.append(int1_Deviation)
                            break
                    break
        deviationMembers = crv1_DeviationClean
        deviationMembersID = id1_DeviationClean
        
        # External Force
        pt1_ExtForceClean = []
        External_Forces_IDClean = []
        for k in xrange(len(externalForces)):
            for i in xrange(len(pt1_Node)):
                int1_ExtForce = []
                if abs(externalForces[k].X - pt1_Node[i].X) < db0_T and abs(externalForces[k].Y - pt1_Node[i].Y) < db0_T and abs(externalForces[k].Z - pt1_Node[i].Z) < db0_T:
                    pt1_ExtForceClean.append(externalForces[k])
                    External_Forces_IDClean.append(externalForcesID[k])
                    int1_ExtForce.append(i)
                    int2_ExtForce.append(int1_ExtForce)
                    break
        
        externalForces = pt1_ExtForceClean
        externalForcesID = External_Forces_IDClean
        
        
        # Extract Attributes External Forces
        st2_externalForcesID = []
        for i in range(len(externalForcesID)):
            st1_externalForcesID = []
            for j in range(len(externalForcesID[i])):
                st1_externalForcesID.append(str(externalForcesID[i][j]))
            st2_externalForcesID.append(st1_externalForcesID)
        str2_ExtForceAtt = st2_externalForcesID

        # Extract Attributes trailMembers
        str1_TrailAtt = [str(x) for x in trailMembersID]

        # Extract Attributes Deviation
        str1_DeviationAtt = [str(x) for x in deviationMembersID]
        
        
        # Create Dictionary of trailMembers' Ends
        dc2_TrailEnds = {}
        for i in xrange(len(int2_Trail)):
            dc2_TrailEnds[str(i)] = [str(x) for x in int2_Trail[i]]
        
        # Create Dictionary of trailMembers' Attributes
        dc1_TrailAtt = {}
        for i in xrange(len(str1_TrailAtt)):
            dc1_TrailAtt[str(i)] = str1_TrailAtt[i]
        
        
        # Create Dictionary of External Forces' End
        dc1_ExtForceEnds = {}
        for i in xrange(len(int2_ExtForce)):
            dc1_ExtForceEnds[str(i)] = str(int2_ExtForce[i][0])
        
        
        # Create Dictionary of External Forces' Attributes
        dc2_ExtForceAtt = {}
        for i in xrange(len(str2_ExtForceAtt)):
            dc2_ExtForceAtt[str(i)] = [x for x in str2_ExtForceAtt[i]]

        
        # Create Lists of Node-Node Connectivity from trailMembers
        int2_Node = []
        for pt0_Node in pt1_Node:
            int1_Node = []
            int2_Node.append(int1_Node)
        for int1_Trail in int2_Trail:
            int2_Node[int1_Trail[0]].append(int1_Trail[1])
            int2_Node[int1_Trail[1]].append(int1_Trail[0])
        
        
        # Create Lists of Deviations' Ends and Attributes
        str2_Deviation = []
        for i in xrange(len(str1_DeviationAtt)):
            str2_Deviation.append( [str(item) for item in int2_Deviation[i] ] )
            str2_Deviation[i].extend([str1_DeviationAtt[i]])
        
        # Convert Trail Input into Polylines
        ln1_Trail = []
        for crv0_Trail in trailMembers:
            if crv0_Trail is Rhino.Geometry.Line:
                ln1_Trail.append(crv0_Trail)
            else:
                ln1_Trail.append(Rhino.Geometry.Line(crv0_Trail.PointAtStart, crv0_Trail.PointAtEnd))
        
        trailMembers = []
        for ln0_Trail in ln1_Trail:
            trailMembers.append(ln0_Trail.ToNurbsCurve())
        
        plc1_Trail = Rhino.Geometry.Curve.JoinCurves(trailMembers)
        
        pln1_Trail = []
        for plc0_Trail in plc1_Trail:
            pln1_Trail.append(plc0_Trail.TryGetPolyline()[1])
        
        
        # Check supports
        pt1_SupportClean = []
        for j in xrange(len(pln1_Trail)):
            if supports:
                pt1_SupportClean.append(pln1_Trail[j][len(pln1_Trail[j])-1])
                for i in xrange(len(supports)):
                    if abs(pln1_Trail[j][0].X - supports[i].X) < db0_T and abs(pln1_Trail[j][0].Y - supports[i].Y) < db0_T and abs(pln1_Trail[j][0].Z - supports[i].Z) < db0_T:
                        pt1_SupportClean[j] = pln1_Trail[j][0]
                        pln1_Trail[j].Reverse()
            else:
                pt1_SupportClean.append(pln1_Trail[j][len(pln1_Trail[j])-1])
        supports = pt1_SupportClean
        
        
        # Find Node Indexes of supports
        int1_Support = []
        for pt0_Support in supports:
            for i in xrange(len(pt1_Node)):
                if abs(pt0_Support.X - pt1_Node[i].X) < db0_T and abs(pt0_Support.Y - pt1_Node[i].Y) < db0_T and abs(pt0_Support.Z - pt1_Node[i].Z) < db0_T:
                    int1_Support.append(i)
                    break
        
        # Create Graph (Dictionary of Node-Node Connectivity from trailMembers)
        dc2_Node = {}
        for i in xrange(len(int2_Node)):
            dc2_Node[str(i)] = [str(x) for x in int2_Node[i]]
        
        int2_TrailPoly = []
        for pln0_Trail in pln1_Trail:
            int1_TrailPoly = []
            for i in xrange(len(pln0_Trail)):
                for k in xrange(len(pt1_Node)):
                    if abs(pln0_Trail[i].X - pt1_Node[k].X) < db0_T and abs(pln0_Trail[i].Y - pt1_Node[k].Y) < db0_T and abs(pln0_Trail[i].Z - pt1_Node[k].Z) < db0_T:
                        int1_TrailPoly.append(k)
                        break
            int2_TrailPoly.append(list(reversed(int1_TrailPoly)))
        
        dc2_ShortPath = {}

        for i in xrange(len(pt1_Node)):
            for int1_TrailPoly in int2_TrailPoly:
                if i in int1_TrailPoly:
                    str1_ShortPath = ["S"]
                    str1_ShortPath.extend(map(str, int1_TrailPoly[:int1_TrailPoly.index(i)+1]))
                    dc2_ShortPath[str(i)] = str1_ShortPath
                    break
        
        dc1_ShortPathDist = {}
        dc2_ShortPathDistGrade = {}
        
        for i in xrange(len(pt1_Node)):
            for pln0_Trail in pln1_Trail:
                for j in xrange(len(pln0_Trail)):
                    if abs(pln0_Trail[j].X - pt1_Node[i].X) < db0_T and abs(pln0_Trail[j].Y - pt1_Node[i].Y) < db0_T and abs(pln0_Trail[j].Z - pt1_Node[i].Z) < db0_T:
                        dc1_ShortPathDist[str(i)] = len(pln0_Trail) - j
                        break
        

        # Define Sequences
        for key in dc1_ShortPathDist:
            if dc1_ShortPathDist[key] not in dc2_ShortPathDistGrade:
                dc2_ShortPathDistGrade[dc1_ShortPathDist[key]] = [key]
            else:
                dc2_ShortPathDistGrade[dc1_ShortPathDist[key]].extend([key])
        
        
        # Separate Deviation1 (direct) and Deviation2 (indirect-bracing)
        
        dc2_Deviation1Ends = {}
        dc2_Deviation2Ends = {}
        
        dc1_Deviation1Att = {}
        dc1_Deviation2Att = {}
        
        int2_Deviation1 = []
        str2_Deviation2 = []
        
        crv1_Deviation1 = []
        crv1_Deviation2 = []
        
        int1_Deviation1ID = []
        int1_Deviation2ID = []
        
        j = 0
        k = 0
        
        
        for i in xrange(len(str2_Deviation)):
            if dc1_ShortPathDist[ str(str2_Deviation[i][0]) ] == dc1_ShortPathDist[ str(str2_Deviation[i][1]) ]:
                dc2_Deviation1Ends[str(j)] = [str(str2_Deviation[i][0]),str(str2_Deviation[i][1])]
                dc1_Deviation1Att[str(j)] = str(str2_Deviation[i][2])
                int2_Deviation1.append([int(str2_Deviation[i][0]),int(str2_Deviation[i][1])])
                crv1_Deviation1.append(deviationMembers[i])
                int1_Deviation1ID.append(i)
                print j
                j += 1
            else:
                dc2_Deviation2Ends[str(k)] = [str(str2_Deviation[i][0]),str(str2_Deviation[i][1])]
                dc1_Deviation2Att[str(k)] = str(str2_Deviation[i][2])
                str2_Deviation2.append(str2_Deviation[i])
                crv1_Deviation2.append(deviationMembers[i])
                int1_Deviation2ID.append(i)
                k += 1
        
        print dc2_Deviation1Ends
        print int1_Deviation1ID
        print int1_Deviation2ID
        
        # Create Dictionary of Trail and Deviation 1 for Structural Matrix
        dc2_EdgeEnds = {}
        dc2_TrailEndsOut = dc2_TrailEnds.copy()
        dc2_Deviation1EndsOut = {}
        
        for key in dc2_TrailEnds:
            dc2_EdgeEnds[str(int(key))] = dc2_TrailEnds[key]
        for key in dc2_Deviation1Ends:
            dc2_EdgeEnds[str(int(key)+len(dc2_TrailEnds))] = dc2_Deviation1Ends[key]
            dc2_Deviation1EndsOut[str(int(key)+len(dc2_TrailEnds))] = dc2_Deviation1Ends[key]
            
        dc1_EdgeAtt = {}
        for key in dc1_TrailAtt:
            dc1_EdgeAtt[str(int(key))] = dc1_TrailAtt[key]
        for key in dc1_Deviation1Att:
            dc1_EdgeAtt[str(int(key)+len(dc1_TrailAtt))] = dc1_Deviation1Att[key]
        
        # Create Dictionary of Trail and Deviation 1 and 2 for Visualization
        dc1_Edge = {}
        for key in dc1_TrailAtt:
            dc1_Edge[str(int(key))] = dc1_TrailAtt[key]
        for key in dc1_Deviation1Att:
            dc1_Edge[str(int(key)+len(dc1_TrailAtt))] = dc1_Deviation1Att[key]
        for key in dc1_Deviation2Att:
            dc1_Edge[str(int(key)+len(dc1_TrailAtt)+len(dc1_Deviation1Att))] = dc1_Deviation2Att[key]
        
        ## Visualization
        
        # Nodes
        pt1_NodeOut = pt1_Node
        pt1_TargetOut = pt1_NodeOut
        str1_NodeOut = [str(i) + " (" + str(dc1_ShortPathDist[str(i)]) + ")" for i in xrange(len(pt1_Node))]
        str1_TargetOut = [str(i) for i in xrange(len(pt1_Node))]
        
        # Edges
        crv1_Edge = []
        for crv0_Trail in trailMembers: crv1_Edge.append(crv0_Trail)
        for crv0_Deviation1 in crv1_Deviation1: crv1_Edge.append(crv0_Deviation1)
        for crv0_Deviation2 in crv1_Deviation2: crv1_Edge.append(crv0_Deviation2)
        
        crv1_EdgeOut = crv1_Edge
        pt1_EdgeOut = [crv0_Edge.PointAtNormalizedLength(0.6) for crv0_Edge in crv1_EdgeOut]
        str1_EdgeOut = [str(i) + " (" + dc1_Edge[str(i)] + ")" for i in xrange(len(crv1_EdgeOut))]

        # Update Lists of Node-Node Connectivity from Deviation 1
        for int1_DevTemp in int2_Deviation1:
            int2_Node[int1_DevTemp[0]].append(int1_DevTemp[1])
            int2_Node[int1_DevTemp[1]].append(int1_DevTemp[0])
        
        
        # Create Graph (Dictionary of Node-Node Connectivity from trailMembers)
        for i in xrange(len(int2_Node)):
            dc2_Node[str(i)] = [str(x) for x in int2_Node[i]]
        
        
        ## Create Dictionaries for Structural Matrix
        dc1_NodeTrailOut = {}
        dc1_NodeTrailIn = {}
        dc2_NodeDeviation = {}
        dc1_NodeExtForce = {}
        dc1_NodeExtForceAtt = {}
        int0_NodeTrailIn = {}

        
        # Trail In and Out
        for key in dc2_ShortPath:
            dc1_NodeTrailOut[key] = dc2_ShortPath[key][len(dc2_ShortPath[key])-2]
        
        int0_ShortPathDistGradeMax = max(dc2_ShortPathDistGrade)
        
        for key in dc1_NodeTrailOut:
            if dc1_NodeTrailOut[key] == "S": dc1_NodeTrailOut[key] = dc1_NodeTrailOut[key] + key
            dc1_NodeTrailIn[dc1_NodeTrailOut[key]] = key

        for key in dc1_NodeTrailOut:
            if key not in dc1_NodeTrailIn:
                str0_Key = "L" + key
                for i in range(int0_ShortPathDistGradeMax - dc1_ShortPathDist[key] + 1):
                    dc1_NodeTrailIn[str0_Key[1:]] = str0_Key
                    str0_Key = "L" + str0_Key

        
        for key in dc1_NodeTrailIn:
            if "L" + key not in dc1_NodeTrailOut:
                dc1_NodeTrailOut[dc1_NodeTrailIn[key]] = key
        
        # Deviation
        for key in dc2_Node:
            str1_v = []
            for v in dc2_Node[key]:
                if v != dc1_NodeTrailOut[key] and v != dc1_NodeTrailIn[key]:
                    str1_v.append(v)
            dc2_NodeDeviation[key] = str1_v
        
        # External Forces
        for key in dc1_ExtForceEnds:
            if dc1_ExtForceEnds[key] not in dc1_NodeExtForce:
                dc1_NodeExtForce[dc1_ExtForceEnds[key]] = [key]
            else:
                dc1_NodeExtForce[dc1_ExtForceEnds[key]].append(key)
        
        for key in dc1_NodeExtForce:
            for v in dc1_NodeExtForce[key]:
                if dc1_ExtForceEnds[v] not in dc1_NodeExtForceAtt:
                    dc1_NodeExtForceAtt[key] = [item for item in dc2_ExtForceAtt[v]]
                else:
                    xx1_NodeExtForceAtt = dc1_NodeExtForceAtt[dc1_ExtForceEnds[v]]
                    for i in xrange(len(xx1_NodeExtForceAtt)):
                        try:
                            xx1_NodeExtForceAtt[i] = float(xx1_NodeExtForceAtt[i])
                        except:
                            xx1_NodeExtForceAtt[i] = -1.0
                            
                            
                    try:
                        dc2_ExtForceAtt[v][0] = float(dc2_ExtForceAtt[v][0])
                    except:
                        dc2_ExtForceAtt[v][0] = -1.0
                    try:
                        dc2_ExtForceAtt[v][1] = float(dc2_ExtForceAtt[v][1])
                    except:
                        dc2_ExtForceAtt[v][1] = -1.0
                    try:
                        dc2_ExtForceAtt[v][2] = float(dc2_ExtForceAtt[v][2])
                    except:
                        dc2_ExtForceAtt[v][2] = -1.0
                    dc1_NodeExtForceAtt[key][0] += float(dc2_ExtForceAtt[v][0])
                    dc1_NodeExtForceAtt[key][1] += float(dc2_ExtForceAtt[v][1])
                    dc1_NodeExtForceAtt[key][2] += float(dc2_ExtForceAtt[v][2])
        
        
        ## Create Structural Matrix According to Weight
        
        # Initialize Matrix with Indices
        str2_StructuralMatrix = []
        str1_NodeOrderMatrix = []
        str2_NodeOrderMatrix = []
        
        str1_NodeOrder = dc2_ShortPathDistGrade[1]

        for i in sorted(xrange(1,len(dc2_ShortPathDistGrade)+1)):
            str1_NodeOrderUp = []
            str2_NodeOrderMatrix.append(str1_NodeOrder)
            for str0_NodeOrder in str1_NodeOrder:
                str1_NodeOrderMatrix.append(str0_NodeOrder)
                if str0_NodeOrder[0] != "L":
                    str2_StructuralMatrix.append(["0"]*(3+len(str1_NodeOrder)+1))
                    str1_NodeOrderUp.append(dc1_NodeTrailIn[str0_NodeOrder])
                    
                else:
                    str2_StructuralMatrix.append(["0"]*(3+len(str1_NodeOrder)+1))
                    str1_NodeOrderUp.append("L" + str0_NodeOrder)
                    dc1_NodeTrailIn[str0_NodeOrder] = str0_NodeOrder[1:]
                    dc2_EdgeEnds[str0_NodeOrder.replace("L","E")] = [str0_NodeOrder[1:], str0_NodeOrder]
                    dc2_TrailEndsOut[str0_NodeOrder.replace("L","E")] = [str0_NodeOrder[1:], str0_NodeOrder]
            str1_NodeOrder = str1_NodeOrderUp
            
        int0_NodeOrderMatrix = len(str2_NodeOrderMatrix[0])

        # Add Attribute External Forces
        for key in dc1_NodeExtForce:
            int0_NodeIndex = str1_NodeOrderMatrix.index(key)
            str2_StructuralMatrix[int0_NodeIndex][0:3] = [str(item) for item in dc1_NodeExtForceAtt[key]]
        
        # Add Attributes Auxiliary Trails
        for key in dc2_EdgeEnds: 
            if key[0] == "E": dc1_EdgeAtt[key] = "0.0"
        
        # Add Attribute Trail Out
        for key in dc2_EdgeEnds:
            if dc2_EdgeEnds[key][0] in dc1_NodeTrailOut and dc2_EdgeEnds[key][1] == dc1_NodeTrailOut[dc2_EdgeEnds[key][0]]:
                int0_NodeIndex = str1_NodeOrderMatrix.index(dc2_EdgeEnds[key][0])
                str2_StructuralMatrix[int0_NodeIndex][len(str2_StructuralMatrix[int0_NodeIndex])-1] = dc1_EdgeAtt[key]
            elif dc2_EdgeEnds[key][1] in dc1_NodeTrailOut and dc2_EdgeEnds[key][0] == dc1_NodeTrailOut[dc2_EdgeEnds[key][1]]:
                int0_NodeIndex = str1_NodeOrderMatrix.index(dc2_EdgeEnds[key][1])
                str2_StructuralMatrix[int0_NodeIndex][len(str2_StructuralMatrix[int0_NodeIndex])-1] = dc1_EdgeAtt[key]
        
        # Add Attribute Deviation
        for key in dc2_EdgeEnds:
            if dc2_EdgeEnds[key][0] in dc2_NodeDeviation and dc2_EdgeEnds[key][1] in dc2_NodeDeviation[dc2_EdgeEnds[key][0]]:
                int0_NodeIndex = str1_NodeOrderMatrix.index(dc2_EdgeEnds[key][0])
                int0_NodeIndexTo = str1_NodeOrderMatrix.index(dc2_EdgeEnds[key][1])
                int0_NodeIndexRaw = (int0_NodeIndexTo) % int0_NodeOrderMatrix
                str2_StructuralMatrix[int0_NodeIndex][3 + int0_NodeIndexRaw] = dc1_EdgeAtt[key]
            if dc2_EdgeEnds[key][1] in dc2_NodeDeviation and dc2_EdgeEnds[key][0] in dc2_NodeDeviation[dc2_EdgeEnds[key][1]]:
                int0_NodeIndex = str1_NodeOrderMatrix.index(dc2_EdgeEnds[key][1])
                int0_NodeIndexTo = str1_NodeOrderMatrix.index(dc2_EdgeEnds[key][0])
                int0_NodeIndexRaw = (int0_NodeIndexTo) % int0_NodeOrderMatrix
                str2_StructuralMatrix[int0_NodeIndex][3 + int0_NodeIndexRaw] = dc1_EdgeAtt[key]
        
        # Order Matrix
        str2_StructuralMatrixOrder = []
        int1_StructuralMatrixOrder = []
        str2_NodeOrderMatrixReversed = []
        
        for i in reversed(xrange(1,len(str2_NodeOrderMatrix)+1)):
            for j in xrange(int0_NodeOrderMatrix):
                int0_Index = int0_NodeOrderMatrix*(i-1)+j
                if i != len(str2_NodeOrderMatrix):
                    int1_StructuralMatrixOrder.append(str2_NodeOrderMatrix[i-1][j])
                str2_StructuralMatrixOrder.append(str2_StructuralMatrix[int0_NodeOrderMatrix*(i-1)+j])
        
        for i in reversed(xrange(1,len(str2_NodeOrderMatrix)+1)):
            str1_NodeOrderMatrixReversed = []
            for j in xrange(int0_NodeOrderMatrix):
                str1_NodeOrderMatrixReversed.append(str2_NodeOrderMatrix[i-1][j])
            str2_NodeOrderMatrixReversed.append(str1_NodeOrderMatrixReversed)

        
        # Substitute Node Index with Matrix Index in Deviation2
        str1_Deviation2 = ListListToList(str2_Deviation2)
        str1_NodeOrder = ListListToList(str2_NodeOrderMatrixReversed)
        
        str1_NodeOrderOut = str1_NodeOrder[:]
        
        # Edge-Node List
        dc2_EdgeEndsComplete = {}
        dc2_EdgeEndsComplete = dict(dc2_EdgeEnds)
        dc2_Deviation2EndsOut = {}
        
        
        int0_EdgeEndsLen = len([k for k in dc2_EdgeEndsComplete if not k.startswith('E')])
        
        for i in range(0,len(str1_Deviation2),3):
            dc2_EdgeEndsComplete[str( int(int0_EdgeEndsLen+i/3) )] = [str1_Deviation2[i],str1_Deviation2[i+1]]
            dc2_Deviation2EndsOut[str( int(int0_EdgeEndsLen+i/3) )] = [str1_Deviation2[i],str1_Deviation2[i+1]]
                
        for i in xrange(len(str1_Deviation2)):
            if (i+1) % 3 != 0:
                str1_Deviation2[i] = str1_NodeOrder.index(str(str1_Deviation2[i]))
        
        
        
        ## Output
        str1_DeviationIndirectOut = str1_Deviation2
        str1_StructuralBehaviourOut = ListListToList(str2_StructuralMatrixOrder)
        
        #### AUTOMATIC GEOMETRIC INPUT FOR FORM DIAGRAM
        
        # str1_NodeOrderOut from Graph with "L" where leaf (as List)
        # str1_NodeOrderC = Clean Node Order without L but duplicated node numbers where needed
        # pt1_NodeOut = geometric locations from vertices in graph
        
        # Amount of layers
        N_layers = len(str1_NodeOrder)/len(supports)
        
        # Create List of Origin Nodes with Indexes
        str1_OriginNodeOut = [str0_OriginNodeOut.replace("L","") for str0_OriginNodeOut in str1_NodeOrder[:len(supports)]]
        pt1_OriginNodeOut = []
        for str0_OriginNodeOut in str1_OriginNodeOut:
            pt1_OriginNodeOut.append(pt1_Node[int(str0_OriginNodeOut)])

        str1_ConstraintPlane = []
        pl1_ConstraintPlane = []

        for key in dc2_TrailEnds:
            
            str0_0 = dc2_TrailEnds[key][0]
            str0_1 = dc2_TrailEnds[key][1]
            int0_0 = dc1_ShortPathDist[str0_0]
            int0_1 = dc1_ShortPathDist[str0_1]
            
            str1_ConstraintPlane.append(str0_0)
            pt0_Start = pt1_NodeOut[int(str0_0)]
            pt0_End = pt1_NodeOut[int(str0_1)]
            
            if int0_0 > int0_1:
                str1_ConstraintPlane[len(str1_ConstraintPlane)-1] = str0_1
                pt0_Start = pt1_NodeOut[int(str0_1)]
                pt0_End = pt1_NodeOut[int(str0_0)]
                
            vc0_Normal = Rhino.Geometry.Vector3d(pt0_End-pt0_Start)
            pl0_Plane = Rhino.Geometry.Plane(pt0_Start,vc0_Normal)
            pl1_ConstraintPlane.append(pl0_Plane)
            

        
        str1_ConstraintPlaneOut = str1_ConstraintPlane
        pl1_ConstraintPlaneOut = pl1_ConstraintPlane

        TP.str1_StructuralBehaviourOut = str1_StructuralBehaviourOut
        TP.str1_DeviationIndirectOut = str1_DeviationIndirectOut
        TP.pt1_NodeOut = pt1_NodeOut
        TP.str1_NodeOut = str1_NodeOut
        TP.crv1_EdgeOut = crv1_EdgeOut
        TP.pt1_EdgeOut = pt1_EdgeOut
        TP.str1_EdgeOut = str1_EdgeOut
        TP.dc2_EdgeEndsCompleteOut = dc2_EdgeEndsComplete
        TP.dc2_TrailEndsOut = dc2_TrailEndsOut
        TP.dc2_Deviation1EndsOut = dc2_Deviation1EndsOut
        TP.dc2_Deviation2EndsOut = dc2_Deviation2EndsOut
        TP.int1_Deviation1ID = int1_Deviation1ID
        TP.int1_Deviation2ID = int1_Deviation2ID
        TP.str1_NodeOrderOut = str1_NodeOrderOut
        TP.str1_ConstraintPlaneOut = str1_ConstraintPlaneOut
        TP.pl1_ConstraintPlaneOut = pl1_ConstraintPlaneOut
        TP.str1_OriginNodeOut = str1_OriginNodeOut
        TP.pt1_OriginNodeOut = pt1_OriginNodeOut


def StringToFloat(val):
    try:
        return float(val)
    except (ValueError, TypeError):
        return 1.0

if TP and hasattr(TP, "str1_StructuralBehaviourOut"):
    str1_StructuralBehaviour = TP.str1_StructuralBehaviourOut[:]
    str1_DeviationIndirect = TP.str1_DeviationIndirectOut[:]
    db1_StructuralBehaviour = []
    db1_DeviationIndirect = []
        
    for i in xrange(len(str1_StructuralBehaviour)):
        db1_StructuralBehaviour.append(StringToFloat(str1_StructuralBehaviour[i]))
    
    for i in xrange(len(str1_DeviationIndirect)):
        db1_DeviationIndirect.append(StringToFloat(str1_DeviationIndirect[i]))

    del TP.str1_StructuralBehaviourOut
    del TP.str1_DeviationIndirectOut
    
    TP.db1_StructuralBehaviourOut = db1_StructuralBehaviour
    TP.db1_DeviationIndirectOut = db1_DeviationIndirect
# ---------- end cem_build_topology ----------

# ---- group: calculate equilibrium structure with CEM
cem_extract_topology = PythonNoHint(TP=cem_build_topology)  # -> nodes, nodesID, edges, edgesID, constraintPlane, constraintPlaneID, originNode, originNodeID
# ---------- cem_extract_topology: Python ----------
"""
Retrieves automatically geometric properties from the topological diagram
    Inputs:
        TP: (topological diagram) The topological diagram used for the calculation of the structural model
    Outputs:
        nodes: (point 3D) The vertices describing the topological diagram
        nodesID: (integer) The corresponding node number
        edges: (edge midpoint) The edges describing the topological diagram
        edgesID: (integer) The corresponding edge number
        constraintPlane: (plane) The planes which are based on the trails normal vectors of the toplogical diagram 
        constraintPlaneID: (integer) The indices of these planes
        originNode: (point 3D) The origin points from the topological diagram
        originNodeID: (integer) The indices of these points
    Remarks:
        This extract geometric information from TP
"""




if TP and hasattr(TP, "str1_NodeOut") and hasattr(TP, "pt1_NodeOut"):
    nodes = TP.pt1_NodeOut
    nodesID = TP.str1_NodeOut


if TP and hasattr(TP, "str1_NodeOut") and hasattr(TP, "pt1_NodeOut"):
    edges = TP.pt1_EdgeOut
    edgesID = TP.str1_EdgeOut


if TP and hasattr(TP, "pl1_ConstraintPlaneOut") and hasattr(TP, "str1_ConstraintPlaneOut"):
    constraintPlane = TP.pl1_ConstraintPlaneOut
    constraintPlaneID = TP.str1_ConstraintPlaneOut

if TP and hasattr(TP, "pt1_OriginNodeOut"):
    originNode = TP.pt1_OriginNodeOut
    originNodeID = TP.str1_OriginNodeOut
# ---------- end cem_extract_topology ----------

# ---- group: calculate equilibrium structure with CEM / Set constaint planes
deplane = DeconstructPlane(Plane=cem_extract_topology.constraintPlane)  # -> Origin, XAxis, YAxis, ZAxis
xy = XYPlane(Origin=Point(0, 0, 0))
sort_pt = SortPoints(Points=deplane.Origin)  # -> Points, Indices
panel_6 = Panel("""0
1
2
4
5
7
-1
-2
-3
-5
-6
-8""")
item = ListItem(List=sort_pt.Indices, Index=panel_6, Wrap=True)  # -> flatten(Item)
replace = ReplaceItems(List=cem_extract_topology.constraintPlane, Item=xy, Indices=item, Wrap=False)
cem_constraint_plane = GhPythonScript(constraintPlane=replace, constraintPlaneID=cem_extract_topology.constraintPlaneID)  # -> CPL; inputs constraintPlane: list of Plane, constraintPlaneID: list of Int32
# ---------- cem_constraint_plane: Python ----------
"""
Assign self weight
    Inputs:
        selfWeight: (bool) Activate the self weight of the structure
        yieldStress: (double) The yield stress of the structural members
        specWeight: (double) The specific weight of the structural members
    Outputs:
        SW: (self-weight) The assigned self weight properties 
    Remarks:
        This generates a new instance of self weight
"""


import Rhino


class CPlane(object):
    def __repr__(self):
        return self.ToString()
        
    def __str__(self):
        return self.ToString()
        
    def ToString(self):
        if constraintPlane and len(constraintPlane) == len(constraintPlaneID):
            return str(len(constraintPlane)) + " Constraint Planes"
        else:
            return "Invalid Constraint Planes"



if constraintPlane:
    CPL = CPlane()
    CPL.constraintPlane = constraintPlane
    CPL.constraintPlaneID = constraintPlaneID
# ---------- end cem_constraint_plane ----------

# ---- group: calculate equilibrium structure with CEM / set origin node coordinates
twist_offset = Slider(0, range=0..0.5)
cable_deck_midspan_distance = Slider(2, range=0.1..2)
tower_base_x_offset = Slider(7.353, range=0..20)
deck_rise = Slider(6, range=2..6)
tower_base_y_offset = Slider(7.832, range=0..10)
sort_pt_2 = SortPoints(Points=cem_extract_topology.originNode)  # -> Points, Indices
bang = ExplodeTree(Data=graft(sort_pt_2.Points))  # -> Branch0, Branch1, Branch2, Branch3, Branch4, Branch5, Branch6, Branch7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
pdecon = Deconstruct(Point=bang.Branch2)  # -> XComponent, YComponent, ZComponent
pdecon_2 = Deconstruct(Point=bang.Branch3)  # -> XComponent, YComponent, ZComponent
pdecon_3 = Deconstruct(Point=bang.Branch11)  # -> XComponent, YComponent, ZComponent
subtraction = Subtraction(A=0.1, B=pdecon_3.ZComponent)
subtraction_2 = Subtraction(A=pdecon_2.ZComponent, B=pdecon.ZComponent)
filter_8 = StreamFilter(Gate=list, Stream0=deck_rise, Stream1=generate_random_input.deck_rise, Stream2=load_input.deck_rise)
filter_9 = StreamFilter(Gate=list, Stream0=twist_offset, Stream1=generate_random_input.twist_offset, Stream2=load_input.twist_offset)
filter_10 = StreamFilter(
    Gate=list,
    Stream0=tower_base_y_offset,
    Stream1=generate_random_input.tower_base_y_offset,
    Stream2=load_input.tower_base_y_offset)
filter_11 = StreamFilter(
    Gate=list,
    Stream0=tower_base_x_offset,
    Stream1=generate_random_input.tower_base_x_offset,
    Stream2=load_input.tower_base_x_offset)
filter_12 = StreamFilter(
    Gate=list,
    Stream0=cable_deck_midspan_distance,
    Stream1=generate_random_input.cable_deck_midspan_distance,
    Stream2=load_input.cable_deck_midspan_distance)
subtraction_3 = Subtraction(A=filter_8, B=pdecon.ZComponent)
subtraction_4 = Subtraction(A=subtraction_3, B=subtraction_2)
neg = Negative(Value=filter_9)
neg_2 = Negative(Value=filter_11)
neg_3 = Negative(Value=filter_10)
addition = Addition(A=subtraction_4, B=filter_12)
Y = UnitY(Factor=-100)
vec = VectorXYZ(XComponent=0, YComponent=filter_9, ZComponent=subtraction_3)  # -> Vector, Length
vec_2 = VectorXYZ(XComponent=0, YComponent=neg, ZComponent=subtraction_3)  # -> Vector, Length
vec_3 = VectorXYZ(XComponent=0, YComponent=filter_9, ZComponent=addition)  # -> Vector, Length
vec_4 = VectorXYZ(XComponent=0, YComponent=neg, ZComponent=addition)  # -> Vector, Length
vec_5 = VectorXYZ(XComponent=filter_11, YComponent=filter_10, ZComponent=subtraction)  # -> Vector, Length
vec_6 = VectorXYZ(XComponent=neg_2, YComponent=filter_10, ZComponent=subtraction)  # -> Vector, Length
vec_7 = VectorXYZ(XComponent=filter_11, YComponent=neg_3, ZComponent=subtraction)  # -> Vector, Length
vec_8 = VectorXYZ(XComponent=neg_2, YComponent=neg_3, ZComponent=subtraction)  # -> Vector, Length
addition_2 = Addition(A=vec.Vector, B=Y)
move = Move(Geometry=bang.Branch6, Motion=addition_2)  # -> Geometry, Transform
move_2 = Move(Geometry=bang.Branch8, Motion=addition_2)  # -> Geometry, Transform
addition_3 = Addition(A=vec_2.Vector, B=Y)
move_3 = Move(Geometry=bang.Branch2, Motion=addition_3)  # -> Geometry, Transform
move_4 = Move(Geometry=bang.Branch4, Motion=addition_3)  # -> Geometry, Transform
addition_4 = Addition(A=vec_3.Vector, B=Y)
move_5 = Move(Geometry=bang.Branch3, Motion=addition_4)  # -> Geometry, Transform
move_6 = Move(Geometry=bang.Branch5, Motion=addition_4)  # -> Geometry, Transform
addition_5 = Addition(A=vec_4.Vector, B=Y)
move_7 = Move(Geometry=bang.Branch7, Motion=addition_5)  # -> Geometry, Transform
move_8 = Move(Geometry=bang.Branch9, Motion=addition_5)  # -> Geometry, Transform
addition_6 = Addition(A=vec_5.Vector, B=Y)
move_9 = Move(Geometry=bang.Branch11, Motion=addition_6)  # -> Geometry, Transform
addition_7 = Addition(A=vec_6.Vector, B=Y)
move_10 = Move(Geometry=bang.Branch1, Motion=addition_7)  # -> Geometry, Transform
addition_8 = Addition(A=vec_7.Vector, B=Y)
move_11 = Move(Geometry=bang.Branch10, Motion=addition_8)  # -> Geometry, Transform
addition_9 = Addition(A=vec_8.Vector, B=Y)
move_12 = Move(Geometry=bang.Branch0, Motion=addition_9)  # -> Geometry, Transform
merge_5 = Merge(
    Data1=move_12.Geometry,
    Data2=move_10.Geometry,
    Data3=move_3.Geometry,
    Data4=move_5.Geometry,
    Data5=move_4.Geometry,
    Data6=move_6.Geometry,
    Data7=move.Geometry,
    Data8=move_7.Geometry,
    Data9=move_2.Geometry,
    Data10=move_8.Geometry,
    Data11=move_11.Geometry,
    Data12=move_9.Geometry)  # -> flatten(Result)

# ----
sort = SortList(Keys=sort_pt_2.Indices, ValuesA=merge_5)  # -> Keys, ValuesA

# ---- group: calculate equilibrium structure with CEM / set origin node coordinates (continued)
cem_origin_node = GhPythonScript(originNode=sort.ValuesA, originNodeID=cem_extract_topology.originNodeID)  # -> N; inputs originNode: list of Point3d, originNodeID: list of Int32
# ---------- cem_origin_node: Python ----------
"""
Locate origin nodes
    Inputs:
        originNode: (point3d) position of origin node in form diagram
        originNodeID: (integer) index of corresponding node
    Outputs:
        N: (origin-nodes) The assigned origin nodes
    Remarks:
        This generates a new instance of origin nodes
"""




import Rhino


class ONode(object):
    def __repr__(self):
        return self.ToString()
        
    def __str__(self):
        return self.ToString()
        
    def ToString(self):
        if originNode and len(originNode) == len(originNodeID):
            return str(len(originNode)) + " Defined Origin Nodes"
        else:
            return "Undefined Origin Nodes"


N = ONode()
if originNode:
    N.originNode = originNode
if originNodeID:
    N.originNodeID = originNodeID
# ---------- end cem_origin_node ----------
# ---- group: calculate equilibrium structure with CEM (continued)
cem_calculate_structure = PythonScript(TP=cem_build_topology, CPL=cem_constraint_plane, N=cem_origin_node)  # -> M
# ---------- cem_calculate_structure: Python ----------
"""
Calculate the structural model
    Inputs:
        TP: (topological diagram) The topological diagram used for the calculation of the structural model
        CPL: (constraintPlaneObject) The constraint planes and their Indices
        N: (originnodeObject) The origin nodes and their Indices
        SW: (selfWeightObject) The Activation of self weight of the structure and their yield stress and specific weight attributes
        O: (optimizationObject) The Settings for an Optimization that can be performed 
    Outputs:
        M: (structural model) The calculated structural model (empty model on error)
    Remarks:
        This generates a new instance of the structural model for a given topological diagram
"""

__author__    = ['Patrick Ole Ohlbrock','Pierluigi D''Acunto' ]
__copyright__ = 'Copyright 2019 - Chair of Structural Design, ETH Zurich'
__license__   = 'MIT License'
__email__     = 'ohlbrock@arch.ethz.ch'
__version__   = "1.80"

"""
If you use the CEM library in a project, please refer to the GitHub repository: 

@Misc{cem2019,
author = {Ohlbrock, Patrick Ole and D'Acunto, Pierluigi},
title = {{CEM: Combinatorial Equilibrium Modeling}},
year = {2019},
note = {Release 1.80},
url = { http://github.com/OleOhlbrock/CEM },
}

"""

import Grasshopper, GhPython
import System
import rhinoscriptsyntax as rs
import Rhino.Geometry as rh
import math
import System.Drawing.Color
import copy
import time
import clr
import os
import collections
from os.path import expanduser
from System import Array, Func

#path = expanduser(str(os.getenv('APPDATA')) + ("\\Grasshopper\\Libraries\\NLoptNet\\NLoptNet.dll"))
#path = expanduser(path)
#
#clr.AddReferenceToFileAndPath(path)
#clr.AddReference('System.Core')

#import NLoptNet as nl

global int0_Counter
global pt2_Trails
global pt1_GlobNodeOut
global ln1_GlobTrailEdgeOut
global ln1_GlobDeviation1EdgeOut
global ln1_GlobDeviation2EdgeOut
global vc2_GlobTrailForce
global ln2_GlobExtEdge
global pt2_GlobNode
global pt2_GlobNodeIteration
global ln2_GlobTrailEdge
global cl2_GlobTrailEdge
global db2_GlobTrailEdge
global ln2_GlobDeviation1Edge
global cl2_GlobDeviation1Edge
global db2_GlobDeviation1Edge
global ln2_GlobDeviation2Edge
global cl2_GlobDeviation2Edge
global db2_GlobDeviation2Edge
global ln2_GlobExtFOEdge
global cl2_GlobExtFOEdge
global db2_GlobExtFOEdge
global int0_CounterOpt 
global db0_DistanceBest
global db1_VariableBest
global str1_TrailEdgeID
global str1_Dev1EdgeID
global str1_Dev2EdgeID
global int1_DevEdgeInputID
global str0_GlobSolver
global str0_GlobDivergence
global str0_GlobIteration

class model(object):
    def __repr__(self):
        return self.ToString()
        
    def __str__(self):
        return self.ToString()
        
    def ToString(self):
        if TPC and hasattr(TPC, "db1_StructuralBehaviourOut"):
            str0_Description = ""
            if int0_LayerCount:
                str0_Description += "Structural Model\n\nlayers: " + str(int0_LayerCount)
                if pt1_GlobNodeOut and ln1_GlobTrailEdgeOut:
                    str0_Description += "\nvertices: " + str(len(pt1_GlobNodeOut)-int0_TrailNumber) + "\ntrail members: " + str(len(ln1_GlobTrailEdgeOut)-int0_TrailNumber) 
                    if ln1_GlobDeviation1EdgeOut:
                        str0_Description += "\ndirect deviation members: " + str(len(ln1_GlobDeviation1EdgeOut))
                    if ln1_GlobDeviation2EdgeOut:
                        str0_Description += "\nindirect deviation members: " + str(len(ln1_GlobDeviation2EdgeOut))
                    if str0_GlobSolver:
                        str0_Description += "\nsolver: " +  str0_GlobSolver
                        if str0_GlobDivergence:
                            str0_Description += "\ndivergence: " +  str0_GlobDivergence
                    return str0_Description
                else:
                    return "Empty Structural Model"
            else:
                return "Empty Structural Model"
        else:
            return "Empty Structural Model"



### AUXILIARY FUNCTIONS
def ListListToList(xx2_Data):
    xx1_DataOut = []
    for xx1_Data in xx2_Data:
        xx1_DataOut.extend(xx1_Data)
    return xx1_DataOut

def TransposeListList(xx2_Data):
    xx2_DataOut = list(map(list, zip(*xx2_Data)))
    return xx2_DataOut
    
def ListToListList(xx1_Data, int0_R, int0_C):
    xx2_DataOut = []
    for i in xrange(int0_R):
        xx1_DataOut = []
        for j in xrange(int0_C):
            xx1_DataOut.append(xx1_Data[j+i*int0_C])
        xx2_DataOut.append(xx1_DataOut)
    return xx2_DataOut

def DataTreeToListList(dt2_Data):
    xx2_DataOut = []
    for i in xrange(dt2_Data.BranchCount):
        xx1_DataOut = []
        for j in xrange(len(dt2_Data.Branch(i))):
            xx1_DataOut.append(dt2_Data.Branch(i)[j])
        xx2_DataOut.append(xx1_DataOut)
    return xx2_DataOut


constraintPlane = []
constraintPlaneID = []

if CPL:
    constraintPlane = CPL.constraintPlane
    constraintPlaneID = CPL.constraintPlaneID


targetNode = []
targetNodeID = []
targetNodeCoeff = 0

#if O and hasattr(O, "targetNode") and hasattr(O, "targetNodeID"):
#    targetNode = O.targetNode
#    targetNodeID = O.targetNodeID
#    targetNodeCoeff = O.targetNodeCoeff

targetVector = []
targetVectorID = []
targetVectorCoeffMag = 0
targetVectorCoeffDir = 0

#if O and hasattr(O, "targetVector") and hasattr(O, "targetVectorID"):
#    targetVector = O.targetVector
#    targetVectorID = O.targetVectorID
#    targetVectorCoeffMag = O.targetVectorCoeffMag
#    targetVectorCoeffDir = O.targetVectorCoeffDir

yieldStress = None
specWeight = None

if SW and hasattr(SW, "yieldStress") and hasattr(SW, "specWeight"):
    yieldStress = SW.yieldStress
    specWeight = SW.specWeight

TPC = copy.deepcopy(TP)

if TPC and hasattr(TPC, "db1_StructuralBehaviourOut"):
    if len(constraintPlane) > 0:
        if len(constraintPlane) == len(constraintPlaneID):
            TPC.pl1_ConstraintPlaneOut = constraintPlane
            TPC.int1_ConstraintPlaneOut = constraintPlaneID
        else:
            TPC.pl1_ConstraintPlaneOut = None
            TPC.int1_ConstraintPlaneOut = None
    else:
        TPC.pl1_ConstraintPlaneOut = None
        TPC.int1_ConstraintPlaneOut = None

    if N and hasattr(N, "originNode"):
        if len(N.originNode) == len(TPC.pt1_OriginNodeOut):
            TPC.pt1_OriginNodeOut = N.originNode
        if hasattr(N, "originNodeID") and len(N.originNodeID) == len(TPC.str1_OriginNodeOut):
            int1_OriginNodeOut = [int(str0_OriginNodeOut) for str0_OriginNodeOut in TPC.str1_OriginNodeOut]
            pt1_OriginNodeShift = []
            if collections.Counter(N.originNodeID) == collections.Counter(int1_OriginNodeOut):
                for int0_OriginNodeID in N.originNodeID:
                    pt1_OriginNodeShift.append(TPC.pt1_OriginNodeOut[int1_OriginNodeOut.index(int0_OriginNodeID)])
                TPC.pt1_OriginNodeOut = pt1_OriginNodeShift


## CREATE LIST OF EDGES IDS

if TPC and hasattr(TPC, "dc2_TrailEndsOut"):
    dc2_TrailEdge = dict( [ [tuple(v),k] for k, v in TPC.dc2_TrailEndsOut.items() ] )

str1_NodeOrder = []
if TPC and hasattr(TPC, "db1_StructuralBehaviourOut"):
    str1_NodeOrder = TPC.str1_NodeOrderOut[:]

# Trail Edge
str1_TrailEdgeID = []
for str0_NodeOrder in str1_NodeOrder:
    for key in dc2_TrailEdge:
        if str0_NodeOrder == key[0] and dc2_TrailEdge[key] != "X":
            str1_TrailEdgeID.append( dc2_TrailEdge[key] )
            dc2_TrailEdge[key] = "X"
        if str0_NodeOrder == key[1] and dc2_TrailEdge[key] != "X":
            str1_TrailEdgeID.append( dc2_TrailEdge[key] )
            dc2_TrailEdge[key] = "X"

# Direct Deviation Edges

dc2_Deviation1EndsOut = []
dc2_Deviation2EndsOut = []
db1_StructuralBehaviourOut = []
pt1_OriginNodeOut = []

if TPC and hasattr(TPC, "db1_StructuralBehaviourOut"):
    dc2_Deviation1EndsOut = TPC.dc2_Deviation1EndsOut
    dc2_Deviation2EndsOut = TPC.dc2_Deviation2EndsOut
    db1_StructuralBehaviourOut = TPC.db1_StructuralBehaviourOut
    pt1_OriginNodeOut = TPC.pt1_OriginNodeOut


    dc2_Dev1Edge = dict( [ [tuple(v),k] for k, v in dc2_Deviation1EndsOut.items() ] )
    dc2_Dev2Edge = dict( [ [tuple(v),k] for k, v in dc2_Deviation2EndsOut.items() ] )

    str1_Dev1EdgeID = []
    db2_StructuralBehaviourOut = []
    for i in range(len(str1_NodeOrder)):
        db1_StructuralBehaviourOutRow = db1_StructuralBehaviourOut[i*(3+len(pt1_OriginNodeOut)+1):(i+1)*(3+len(pt1_OriginNodeOut)+1)]
        db2_StructuralBehaviourOut.append(db1_StructuralBehaviourOutRow)
    
    for i in range(len(db2_StructuralBehaviourOut)):
        for j in range(4+(i % (len(db2_StructuralBehaviourOut[i])-4) ) ,len(db2_StructuralBehaviourOut[i])-1):
            if db2_StructuralBehaviourOut[i][j] != 0:
                id_i = str1_NodeOrder[i]
                id_j = str1_NodeOrder[ (i // (len(db2_StructuralBehaviourOut[i])-4)) * (len(db2_StructuralBehaviourOut[i])-4) + j-3]
                if (id_i,id_j) in dc2_Dev1Edge:
                    str1_Dev1EdgeID.append(dc2_Dev1Edge[(id_i,id_j)])
                else:
                    str1_Dev1EdgeID.append(dc2_Dev1Edge[(id_j,id_i)])
    
    # Indirect Deviation Edges
    int1_Dev2EdgeID = sorted([int(key) for key in dc2_Deviation2EndsOut.copy()])
    str1_Dev2EdgeID = [str(key) for key in int1_Dev2EdgeID]
    
    int1_DevEdgeInputID = []
    if TPC and hasattr(TPC, "db1_StructuralBehaviourOut"):
        int1_DevEdgeInputID = TPC.int1_Deviation1ID[:]
        int1_DevEdgeInputID.extend(TPC.int1_Deviation2ID)


### EQUILIBRIUM FUNCTION
def Equilibrium(db1_StructuralBehaviour, xx1_Bracing, pt1_OriginNode, pl1_ConstraintPlane):
    
    global int0_Counter     # global counter
    


    
    g = 0                                   
    ### ITERATE FOR EACH LAYER OF THE STRUCTURE
    
    ## Initialize
    pt1_InputNode = []
    
    
    for g in xrange(int0_LayerCount):
        
        vc1_TrailForceIn = []
        
        if g == 0:
            pt1_InputNode = pt1_OriginNode
            for i in xrange(int0_TrailNumber):
                vc1_TrailForceIn.append(rh.Vector3d(0,0,0)) 
        else:
            pt1_InputNode = pt2_GlobNode[g-1]
            for i in xrange(int0_TrailNumber):
                vc1_TrailForceIn.append(-vc2_GlobTrailForce[g-1][i])
    
        # Extract Deviation Matrix
        db2_DevForceMag = []

        for i in range(g * int0_TrailNumber, (g + 1) * int0_TrailNumber):
            db1_DevForceMag = []
            for j in range(3, int0_TrailNumber + 3):
                db1_DevForceMag.append(db2_StructuralBehaviour[i][j])
            db2_DevForceMag.append(db1_DevForceMag)
    
    
        ### LAYER DEVELOPMENT
        
        ## Initialize Layer
        
        
        # Create Deviation Length and Unit Vector Matrix
        vc2_DevLengthVector = []
        vc2_DevUnitVector = []
        db2_DevLengthVector = []
        
        vc2_DevLengthVector = [ [rh.Vector3d(0.0,0.0,0.0) for i in xrange(int0_TrailNumber)] for i in xrange(int0_TrailNumber)]
        vc2_DevUnitVector = [ [rh.Vector3d(0.0,0.0,0.0) for i in xrange(int0_TrailNumber)] for i in xrange(int0_TrailNumber)]
        db2_DevLengthVector = [ [0.0 for i in xrange(int0_TrailNumber)] for i in xrange(int0_TrailNumber)]
        
        for i in xrange(int0_TrailNumber):
            for j in xrange(int0_TrailNumber):
                if abs(db2_DevForceMag[i][j]) > db0_Threshold:
                    vc0_InputNode_j = rh.Vector3d(pt1_InputNode[j])
                    vc0_InputNode_i = rh.Vector3d(pt1_InputNode[i])
                    vc0_DevLengthVector = vc0_InputNode_j - vc0_InputNode_i
                    vc2_DevLengthVector[i][j] = vc0_DevLengthVector
                    vc2_DevLengthVector[j][i] = -vc0_DevLengthVector
                    db0_DevLengthVector = vc0_DevLengthVector.Length
                    db2_DevLengthVector[i][j] = db0_DevLengthVector
                    db2_DevLengthVector[j][i] = db0_DevLengthVector
                    vc0_DevUnitVector = rh.Vector3d(vc0_DevLengthVector.X/db0_DevLengthVector, vc0_DevLengthVector.Y/db0_DevLengthVector, vc0_DevLengthVector.Z/db0_DevLengthVector)
                    vc2_DevUnitVector[i][j] = vc0_DevUnitVector
                    vc2_DevUnitVector[j][i] = -vc0_DevUnitVector
        
        
        
        ### MAIN FUNCTION
        
        # Create List of External Forces
        # list for external and bracing forces
        db1_ExtForceX = []
        db1_ExtForceY = []
        db1_ExtForceZ = []
        
        # list for external forces only
        db1_ExtFOX = []
        db1_ExtFOY = []
        db1_ExtFOZ = []
        
        # Add External Forces from Matrix    
        for i in xrange(g*int0_TrailNumber,(g+1)*int0_TrailNumber):
            db1_ExtFOX.append(db2_StructuralBehaviour[i][0])
            db1_ExtFOY.append(db2_StructuralBehaviour[i][1])
            db1_ExtFOZ.append(db2_StructuralBehaviour[i][2])
            
        for i in xrange(g*int0_TrailNumber,(g+1)*int0_TrailNumber):
            db1_ExtForceX.append(db2_StructuralBehaviour[i][0])
            db1_ExtForceY.append(db2_StructuralBehaviour[i][1])
            db1_ExtForceZ.append(db2_StructuralBehaviour[i][2])
            
            # Add Magnitudes of Bracing Forces as External Forces
            # Start node of bracing
            if len(xx1_Bracing) > 0:
                if int0_Counter != 0:
                    for j in xrange(0,len(xx1_Bracing),3):
                        int0_BracingFromLayerIndex = int(xx1_Bracing[j]) // int0_TrailNumber
                        if i == int(xx1_Bracing[j]):
                            pt0_BracingFrom = pt2_GlobNodeIteration[g][i-g*int0_TrailNumber]
                            int0_BracingToLayerIndex = int(xx1_Bracing[j+1]) // int0_TrailNumber
                            int0_BracingToTrailIndex = int(xx1_Bracing[j+1]) % int0_TrailNumber
                            pt0_BracingTo = pt2_GlobNodeIteration[int0_BracingToLayerIndex][int0_BracingToTrailIndex]
                            vc0_ForceA = rh.Vector3d(pt0_BracingTo-pt0_BracingFrom)
                            rh.Vector3d.Unitize(vc0_ForceA)
                            vc0_ForceA = float(xx1_Bracing[j+2])*vc0_ForceA
                            db1_ExtForceX[i-g*int0_TrailNumber] += vc0_ForceA.X
                            db1_ExtForceY[i-g*int0_TrailNumber] += vc0_ForceA.Y
                            db1_ExtForceZ[i-g*int0_TrailNumber] += vc0_ForceA.Z
                        
            # End node of bracing
            if len(xx1_Bracing) > 0:
                if int0_Counter != 0:
                    for j in xrange(1,len(xx1_Bracing),3):
                        int0_BracingFromLayerIndex = int(xx1_Bracing[j]) // int0_TrailNumber
                        if i == int(xx1_Bracing[j]):
                            pt0_BracingFrom = pt2_GlobNodeIteration[g][i-g*int0_TrailNumber]
                            int0_BracingToLayerIndex = int(xx1_Bracing[j-1]) // int0_TrailNumber
                            int0_BracingToTrailIndex = int(xx1_Bracing[j-1]) % int0_TrailNumber
                            pt0_BracingTo = pt2_GlobNodeIteration[int0_BracingToLayerIndex][int0_BracingToTrailIndex]
                            vc0_ForceA = rh.Vector3d(pt0_BracingTo-pt0_BracingFrom)
                            rh.Vector3d.Unitize(vc0_ForceA)
                            vc0_ForceA = float(xx1_Bracing[j+1])*vc0_ForceA
                            db1_ExtForceX[i-g*int0_TrailNumber] += vc0_ForceA.X
                            db1_ExtForceY[i-g*int0_TrailNumber] += vc0_ForceA.Y
                            db1_ExtForceZ[i-g*int0_TrailNumber] += vc0_ForceA.Z
        
        # Vector sum of external and bracing forces for the equilibrium calculation
        vc1_ExtForce = []
        for i in xrange(int0_TrailNumber):
            vc0_ExtForce = rh.Vector3d(db1_ExtForceX[i],db1_ExtForceY[i],db1_ExtForceZ[i])
            vc1_ExtForce.append(vc0_ExtForce)
        
        # Vector sum of external forces only for visualization
        vc1_ExtFO = []
        for i in xrange(int0_TrailNumber):
            vc0_ExtFO = rh.Vector3d(db1_ExtFOX[i],db1_ExtFOY[i],db1_ExtFOZ[i])
            vc1_ExtFO.append(vc0_ExtFO)
        
        # Add External Forces to the Form Diagram
        ln1_ExtFOEdge = []
        cl1_ExtFOEdge = []
        db1_ExtFOEdge = []
        
        for i in xrange(len(vc1_ExtFO)):
            ln1_ExtFOEdge.append(rh.Line(pt1_InputNode[i],(pt1_InputNode[i] + vc1_ExtFO[i])))
            cl1_ExtFOEdge.append(System.Drawing.Color.DarkGreen)
            db1_ExtFOEdge.append(abs(vc1_ExtFO[i].Length))
        
        # Extract Deviation Matrix
        db2_DevForceMag = []
        
        for i in xrange(g*int0_TrailNumber,(g+1)*int0_TrailNumber):
            db1_DevForceMag = []
            for j in xrange(3,int0_TrailNumber+3):
                db1_DevForceMag.append(db2_StructuralBehaviour[i][j])
            db2_DevForceMag.append(db1_DevForceMag)
        
        
        # Create Trail Length and Static Action Matrix from Input Origin Points
        db1_TrailLength = []
        db1_TrailStatAct = []
        
        for i in xrange(g*int0_TrailNumber,(g+1)*int0_TrailNumber):
            db1_TrailLength.append(db2_StructuralBehaviour[i][int0_TrailNumber+3])
            if g == 0:
                db1_TrailStatAct.append(0)
            else:
                db1_TrailStatAct.append(abs((db2_StructuralBehaviour[i-int0_TrailNumber][int0_TrailNumber+3]*vc1_TrailForceIn[i-g*int0_TrailNumber]).Length))
        
        # Calculate Hadamard Product of Deviation Length Matrix and Deviation Matrix
        vc2_DevForce = []
        db2_DevStatAct = []
        
        for i in xrange(int0_TrailNumber):
            vc1_DevForce = []
            db1_DevStatAct = []
            for j in xrange(int0_TrailNumber):
                vc0_DevForce = vc2_DevUnitVector[i][j]*db2_DevForceMag[i][j]
                db0_DevStatAct = abs(db2_DevLengthVector[i][j]*db2_DevForceMag[i][j])
                vc1_DevForce.append(vc0_DevForce)
                db1_DevStatAct.append(db0_DevStatAct)
            vc2_DevForce.append(vc1_DevForce)
            db2_DevStatAct.append(db1_DevStatAct)

        
        # Sum Deviation Vectors and Static Action per each Node
        vc1_DevForceSum = []
        db1_DevStatActSum = []
        db1_IndDevStatActSum = []
        
        for i in xrange(int0_TrailNumber):
            vc0_DevForceSum = rh.Vector3d(0,0,0)
            db0_DevStatActSum = 0
            for j in xrange(int0_TrailNumber):
                vc0_DevForceSum += vc2_DevForce[i][j]
                db0_DevStatActSum += db2_DevStatAct[i][j]
            vc1_DevForceSum.append(vc0_DevForceSum)
            db1_DevStatActSum.append(db0_DevStatActSum)
        # Get Static Action per Node for Indirect Deviations
        # Start Node of Inderect Deviations
        if specWeight and yieldStress and len(xx1_Bracing) > 0:
            int1_StartBracingIndex = []
            int1_EndBracingIndex = []
            db1_BracingValue = []
            for i in xrange(0,len(xx1_Bracing),3):
                int1_StartBracingIndex.append(int(xx1_Bracing[i]))
                int1_EndBracingIndex.append(int(xx1_Bracing[i+1]))
                db1_BracingValue.append(float(xx1_Bracing[i+2]))
            for i in xrange(int0_TrailNumber):
                if int0_Counter != 0:
                    int1_StartBracingIndex_C = int1_StartBracingIndex[:]
                    int1_EndBracingIndex_C = int1_EndBracingIndex[:]
                    db1_BracingValue_C = db1_BracingValue[:]
                    db0_IndDevStatActSum = 0
                    for j in int1_StartBracingIndex:
                        if g*int0_TrailNumber + i == j:
                            int0_StartBracingIndex = int1_StartBracingIndex_C.index(g*int0_TrailNumber + i)
                            int0_StartBracingGlobIndex = g*int0_TrailNumber + i
                            int0_EndBracingGlobIndex = int1_EndBracingIndex_C[ int0_StartBracingIndex ]
                            db0_ValueBracingGlobIndex = db1_BracingValue_C[ int0_StartBracingIndex ]
                            int1_StartBracingIndex_C.pop( int0_StartBracingIndex )
                            int1_EndBracingIndex_C.pop( int0_StartBracingIndex )
                            db1_BracingValue_C.pop( int0_StartBracingIndex )
                            # Get Start and End Nodes of Bracing
                            int0_StartBracingLayer = g
                            int0_StartBracingTrail = i
                            int0_EndBracingLayer = int0_EndBracingGlobIndex // int0_TrailNumber
                            int0_EndBracingTrail = int0_EndBracingGlobIndex % int0_TrailNumber
                            pt0_StartBracing = pt2_GlobNodeIteration[int0_StartBracingLayer][int0_StartBracingTrail]
                            pt0_EndBracing = pt2_GlobNodeIteration[int0_EndBracingLayer][int0_EndBracingTrail]
                            db0_IndDevStatActSum += abs(db0_ValueBracingGlobIndex*pt0_StartBracing.DistanceTo(pt0_EndBracing))
                    db1_IndDevStatActSum.append(db0_IndDevStatActSum)
                        
            # End Node of Inderect Deviations
            int1_StartBracingIndex = []
            int1_EndBracingIndex = []
            db1_BracingValue = []
            for i in xrange(1,len(xx1_Bracing),3):
                int1_StartBracingIndex.append(int(xx1_Bracing[i-1]))
                int1_EndBracingIndex.append(int(xx1_Bracing[i]))
                db1_BracingValue.append(float(xx1_Bracing[i+1]))
            for i in xrange(int0_TrailNumber):
                if int0_Counter != 0:
                    int1_StartBracingIndex_C = int1_StartBracingIndex[:]
                    int1_EndBracingIndex_C = int1_EndBracingIndex[:]
                    db1_BracingValue_C = db1_BracingValue[:]
                    db0_IndDevStatActSum = 0
                    for j in int1_EndBracingIndex:
                        if g*int0_TrailNumber + i == j:
                            int0_EndBracingIndex = int1_EndBracingIndex_C.index(g*int0_TrailNumber + i)
                            int0_EndBracingGlobIndex = g*int0_TrailNumber + i
                            int0_StartBracingGlobIndex = int1_StartBracingIndex_C[ int0_EndBracingIndex ]
                            db0_ValueBracingGlobIndex = db1_BracingValue_C[ int0_EndBracingIndex ]
                            int1_StartBracingIndex_C.pop( int0_EndBracingIndex )
                            int1_EndBracingIndex_C.pop( int0_EndBracingIndex )
                            db1_BracingValue_C.pop( int0_EndBracingIndex )
                            # Get Start and End Nodes of Bracing
                            int0_EndBracingLayer = g
                            int0_EndBracingTrail = i
                            int0_StartBracingLayer = int0_StartBracingGlobIndex // int0_TrailNumber
                            int0_StartBracingTrail = int0_StartBracingGlobIndex % int0_TrailNumber
                            pt0_StartBracing = pt2_GlobNodeIteration[int0_StartBracingLayer][int0_StartBracingTrail]
                            pt0_EndBracing = pt2_GlobNodeIteration[int0_EndBracingLayer][int0_EndBracingTrail]
                            db0_IndDevStatActSum += abs(db0_ValueBracingGlobIndex*pt0_StartBracing.DistanceTo(pt0_EndBracing))
                    db1_IndDevStatActSum[i] += db0_IndDevStatActSum
        else:
            db1_IndDevStatActSum = [0.0 for i in range(int0_TrailNumber)]
        
        # Construct Equilibrium per each Node
        vc1_TrailForceOut = []
        vc1_SelfWeight = []
        for i in xrange(int0_TrailNumber):
            if int0_Counter == 0 and len(xx1_Bracing) > 0:
                if specWeight and yieldStress:
                    vc0_SelfWeight = rh.Vector3d(((db1_TrailStatAct[i] + db1_DevStatActSum[i]/2)*specWeight/yieldStress)*(-rh.Vector3d.ZAxis))
                    vc0_TrailForceOut = -(vc1_ExtForce[i] + vc1_DevForceSum[i] + vc1_TrailForceIn[i] + vc0_SelfWeight)
                    vc1_TrailForceOut.append(vc0_TrailForceOut)
                    vc1_SelfWeight.append(vc0_SelfWeight)
                else:
                    vc0_TrailForceOut = -(vc1_ExtForce[i] + vc1_DevForceSum[i] + vc1_TrailForceIn[i])
                    vc1_TrailForceOut.append(vc0_TrailForceOut)
            else:
                if specWeight and yieldStress:
                    vc0_SelfWeight = rh.Vector3d(((db1_TrailStatAct[i] + db1_DevStatActSum[i]/2 + db1_IndDevStatActSum[i]/2 )*specWeight/yieldStress)*(-rh.Vector3d.ZAxis))
                    vc0_TrailForceOut = -(vc1_ExtForce[i] + vc1_DevForceSum[i] + vc1_TrailForceIn[i] + vc0_SelfWeight)
                    vc1_TrailForceOut.append(vc0_TrailForceOut)
                    vc1_SelfWeight.append(vc0_SelfWeight)
                else:
                    vc0_TrailForceOut = -(vc1_ExtForce[i] + vc1_DevForceSum[i] + vc1_TrailForceIn[i])
                    vc1_TrailForceOut.append(vc0_TrailForceOut)
                

        # Add Self Weight to the Form Diagram
        # external force plus self-weight
        for i in xrange(len(vc1_SelfWeight)):
            ln1_ExtFOEdge.append(rh.Line(pt1_InputNode[i],(pt1_InputNode[i] + vc1_SelfWeight[i])))
            cl1_ExtFOEdge.append(System.Drawing.Color.DarkGreen)
            db1_ExtFOEdge.append(abs(vc1_SelfWeight[i].Length))
        
        
        ## Construction Form Diagram
        
        # Find New Nodes
       
        pt1_Node = []
        
        for i in xrange(int0_TrailNumber):
            vc0_TrailForceOutUn = rh.Vector3d(vc1_TrailForceOut[i])
            rh.Vector3d.Unitize(vc0_TrailForceOutUn)
            ln0_TrailOut = rh.Line(pt1_InputNode[i],vc0_TrailForceOutUn)
            pt0_Node = pt1_InputNode[i] + vc0_TrailForceOutUn*db1_TrailLength[i]
            pt1_Node.append(pt0_Node)
            
            # Modify result in case of constraint planes
            if pl1_ConstraintPlane:
                if g != int0_LayerCount-1:
                    for j in xrange(len(id_NodePlane)):
                        if str(str1_NodeOrderC[((g+1)*int0_TrailNumber)+i]) == str(id_NodePlane[j]):
                            pl0_PlaneTrailOut = pl1_ConstraintPlane[j]
                            if pl0_PlaneTrailOut is not None:
                                xx1_Intersect = rh.Intersect.Intersection.LinePlane(ln0_TrailOut,pl0_PlaneTrailOut)
                                bl0_Intersect = xx1_Intersect[0]
                                db0_Intersect = xx1_Intersect[1]
                                if abs(db0_Intersect) < abs(db0_Threshold):
                                    db1_TrailLength[i] = 0.0
                                    pt0_Node = pt1_InputNode[i]
                                if bl0_Intersect and abs(db0_Intersect) > abs(db0_Threshold):
                                    pt0_Node = ln0_TrailOut.PointAt(db0_Intersect)
                                    db1_TrailLength[i] = pt1_InputNode[i].DistanceTo(pt0_Node)*db0_Intersect/abs(db0_Intersect)
                    pt1_Node[len(pt1_Node)-1] = pt0_Node
        
        # Build Trail Edges
        ln1_TrailEdge = []
        cl1_TrailEdge = []
        db1_TrailEdge = []
        
        for i in xrange(int0_TrailNumber):
            ln0_TrailEdge = rh.Line(pt1_InputNode[i],pt1_Node[i])
            ln1_TrailEdge.append(ln0_TrailEdge)
            if db1_TrailLength[i] > 0.0:
                cl1_TrailEdge.append(System.Drawing.Color.Red)
                db1_TrailEdge.append(vc1_TrailForceOut[i].Length)
            elif db1_TrailLength[i] < 0.0:
                cl1_TrailEdge.append(System.Drawing.Color.Blue)
                db1_TrailEdge.append(-vc1_TrailForceOut[i].Length)
            else:
                cl1_TrailEdge.append(System.Drawing.Color.Black)
                db1_TrailEdge.append(0.0)
            #db1_TrailEdge.append(abs(vc1_TrailForceOut[i].Length))


        # Build Deviation Edges
        ln1_Deviation1Edge = []
        cl1_Deviation1Edge = []
        db1_Deviation1Edge = []
        k = 3
        
        for i in xrange(g*int0_TrailNumber,(g+1)*int0_TrailNumber):
            k += 1
            for j in xrange(k,int0_TrailNumber+3):
                if db2_StructuralBehaviour[i][j] != 0:
                    ln0_Deviation1Edge = rh.Line(pt1_InputNode[i % int0_TrailNumber],pt1_InputNode[j-3])
                    ln1_Deviation1Edge.append(ln0_Deviation1Edge)
                    if db2_StructuralBehaviour[i][j] > 0.0:
                        cl1_Deviation1Edge.append(System.Drawing.Color.Red)
                    else:
                        cl1_Deviation1Edge.append(System.Drawing.Color.Blue)
                    #db1_Deviation1Edge.append(abs(db2_StructuralBehaviour[i][j]))
                    db1_Deviation1Edge.append(db2_StructuralBehaviour[i][j])
        vc2_GlobTrailForce.append(vc1_TrailForceOut)


        # Form Diagram
        ln2_GlobTrailEdge.append(ln1_TrailEdge)
        db2_GlobTrailEdge.append(db1_TrailEdge)
        cl2_GlobTrailEdge.append(cl1_TrailEdge)
        ln2_GlobDeviation1Edge.append(ln1_Deviation1Edge)
        cl2_GlobDeviation1Edge.append(cl1_Deviation1Edge)
        db2_GlobDeviation1Edge.append(db1_Deviation1Edge)
        ln2_GlobExtFOEdge.append(ln1_ExtFOEdge)
        cl2_GlobExtFOEdge.append(cl1_ExtFOEdge)
        db2_GlobExtFOEdge.append(db1_ExtFOEdge)
        pt2_GlobNode.append(pt1_Node)

        g += 1
    
    # Add Reactions to Form Diagram
    for i in xrange(len(vc2_GlobTrailForce[g-1])):
        if cl2_GlobTrailEdge[g-1][i] != System.Drawing.Color.Blue:
            ln1_ExtFOEdge.append(rh.Line(pt2_GlobNode[g-1][i],(pt2_GlobNode[g-1][i] + vc2_GlobTrailForce[g-1][i])))
            db1_ExtFOEdge.append(abs(ln1_ExtFOEdge[len(ln1_ExtFOEdge)-1].Length))
        else:
            ln1_ExtFOEdge.append(rh.Line((pt2_GlobNode[g-1][i] - vc2_GlobTrailForce[g-1][i]),pt2_GlobNode[g-1][i]))
            db1_ExtFOEdge.append(abs(ln1_ExtFOEdge[len(ln1_ExtFOEdge)-1].Length))
        cl1_ExtFOEdge.append(System.Drawing.Color.DarkGreen)
        
    # Update Counter
    int0_Counter += 1
    
    
    return


### MAIN FUNCTION
def Main(db1_StructuralBehaviour, str1_NodeOrderC, xx1_Bracing, pl1_ConstraintPlane, id_NodePlane, pt1_OriginNode, str1_Edge, db0_Divergence, db0_Threshold, int0_CounterBracing, int0_TrailNumber, int0_C, int0_R, db2_StructuralBehaviour, int0_LayerCount, db1_Variable, bl0_Print):

    ### GLOBAL VARIABLES
    
    global pt2_Trails
    global pt1_GlobNodeOut
    global ln1_GlobTrailEdgeOut
    global ln1_GlobDeviation1EdgeOut
    global ln1_GlobDeviation2EdgeOut
    global vc2_GlobTrailForce
    global ln2_GlobExtEdge
    global pt2_GlobNode
    global pt2_GlobNodeIteration
    global ln2_GlobTrailEdge
    global cl2_GlobTrailEdge
    global db2_GlobTrailEdge
    global ln2_GlobDeviation1Edge
    global cl2_GlobDeviation1Edge
    global db2_GlobDeviation1Edge
    global ln2_GlobDeviation2Edge
    global cl2_GlobDeviation2Edge
    global db2_GlobDeviation2Edge
    global ln2_GlobExtFOEdge
    global cl2_GlobExtFOEdge
    global db2_GlobExtFOEdge
    global int0_CounterOpt 
    global db0_DistanceBest
    global db1_VariableBest
    global str1_TrailEdgeID
    global str1_Dev1EdgeID
    global str1_Dev2EdgeID
    global int1_DevEdgeInputID
    global str0_GlobSolver
    global str0_GlobDivergence
    global str0_GlobIteration
    
    
    if bl0_Print:
        int0_CounterOpt += 1
        str0_DescriptionOpt = ""
        str0_DescriptionOpt += "\niteration: " + str(int0_CounterOpt)
    
    str0_GlobIteration = str(int0_CounterOpt)
    
    
    # Initialization of Nodes' Position
    for j in xrange(int0_LayerCount+1):
        pt1_GlobNodeIteration = []
        pt2_GlobNodeIteration.append(pt1_GlobNodeIteration)
    
    
    # Re-Inatialize Global Variables
    dbl0_Divergence = 0
    vc2_GlobTrailForce = []
    ln2_GlobExtEdge = []
    pt2_GlobNode = []
    ln2_GlobTrailEdge = []
    cl2_GlobTrailEdge = []
    db2_GlobTrailEdge = []
    ln2_GlobDeviation1Edge = []
    cl2_GlobDeviation1Edge = []
    db2_GlobDeviation1Edge = []
    ln2_GlobDeviation2Edge = []
    cl2_GlobDeviation2Edge = []
    db2_GlobDeviation2Edge = []
    ln2_GlobExtFOEdge = []
    cl2_GlobExtFOEdge = []
    db2_GlobExtFOEdge = []
    
    
    # Initial Check
    int0_StructuralLayersMatrix = int(len(db1_StructuralBehaviour)/(3+len(pt1_OriginNode)+1)/len(pt1_OriginNode))
    if db1_StructuralBehaviour == None or int0_StructuralLayersMatrix == 0:
        print(str("Please input Matrix of Structural Behaviour"))
        if len(pt1_OriginNode) == 0:
            print(str("Please input Origin Points"))
    else:
        if len(pt1_OriginNode) == 0:
            print(str("Please input Origin Points"))
        else:
            pt1_OriginNodeMod = [pt0_OriginNode for pt0_OriginNode in pt1_OriginNode]
            
            
            # Update Variables for Optimization
            if len(db1_Variable) > 0:
                int0_CountVar = 0
                
                for i in range(len(int2_Deviation1Edge)):
                    key1 = int2_Deviation1Edge[i][0] % int0_TrailNumber + 3
                    key0 = (int2_Deviation1Edge[i][0] // int0_TrailNumber)*int0_TrailNumber + int2_Deviation1Edge[i][1] - 3
                    db2_StructuralBehaviour[int2_Deviation1Edge[i][0]][int2_Deviation1Edge[i][1]] =  db1_Variable[int0_CountVar]
                    db2_StructuralBehaviour[key0][key1] = db1_Variable[int0_CountVar]
                    int0_CountVar += 1
                for i in range(len(int2_TrailEdge)):
                    db2_StructuralBehaviour[ int2_TrailEdge[i][0] ][ int2_TrailEdge[i][1]]  =  db1_Variable[int0_CountVar]
                    int0_CountVar += 1
                for i in range(2,len(xx1_Bracing),3):
                    xx1_Bracing[i] = db1_Variable[int0_CountVar]
                    int0_CountVar += 1
                for i in range(len(pt1_OriginNode)):
                    pt1_OriginNodeMod[i] = rh.Point3d(db1_Variable[int0_CountVar], pt1_OriginNode[i].Y, pt1_OriginNode[i].Z)
                    int0_CountVar += 1
                for i in range(len(pt1_OriginNode)):
                    pt1_OriginNodeMod[i] = rh.Point3d(pt1_OriginNodeMod[i].X, db1_Variable[int0_CountVar], pt1_OriginNode[i].Z)
                    int0_CountVar += 1
                for i in range(len(pt1_OriginNode)):
                    pt1_OriginNodeMod[i] = rh.Point3d(pt1_OriginNodeMod[i].X, pt1_OriginNodeMod[i].Y, db1_Variable[int0_CountVar])
                    int0_CountVar += 1

                    
                    
            # Start Iteration
            while int0_Counter < int0_CounterBracing and db0_Divergence > db0_Threshold:
                
                # Call Main Function
                Equilibrium(db1_StructuralBehaviour, xx1_Bracing, pt1_OriginNodeMod, pl1_ConstraintPlane)
                
                # Store Nodes' Position
                # Here the original line was:
                # pt2_GlobNodeIteration[0] = pt1_OriginNode
                
                pt2_GlobNodeIteration[0] = pt1_OriginNodeMod
                
                for j in xrange(1,len(pt2_GlobNode)+1):
                    if int0_Counter-1 != 0:
                        db0_Divergence = 0
                        for k in xrange(len(pt2_GlobNode[j-1])):
                            db0_Divergence += pt2_GlobNode[j-1][k].DistanceTo(pt2_GlobNodeIteration[j][k])
                    pt2_GlobNodeIteration[j] = pt2_GlobNode[j-1]
                
                if bl0_Print:
                    str0_Description = ""
                    
                    str0_Description += "sub-iteration: " + str(int0_Counter) + "\n"
                    if len(xx1_Bracing) == 0:
                        db0_Divergence = 0.00
                    str0_Description += "divergence: " + str(db0_Divergence)
                    
                    print str0_Description

                
                if int0_Counter < int0_CounterBracing and db0_Divergence > db0_Threshold:
                    # Re-Inatialize Global Variables
                    dbl0_Divergence = 0
                    vc2_GlobTrailForce = []
                    ln2_GlobExtEdge = []
                    pt2_GlobNode = []
                    ln2_GlobTrailEdge = []
                    cl2_GlobTrailEdge = []
                    db2_GlobTrailEdge = []
                    ln2_GlobDeviation1Edge = []
                    cl2_GlobDeviation1Edge = []
                    db2_GlobDeviation1Edge = []
                    ln2_GlobDeviation2Edge = []
                    cl2_GlobDeviation2Edge = []
                    db2_GlobDeviation2Edge = []
                    ln2_GlobExtFOEdge = []
                    cl2_GlobExtFOEdge = []
                    db2_GlobExtFOEdge = []
    
                if int0_Counter == int0_CounterBracing or db0_Divergence < db0_Threshold:
                    
                    # Add Bracing
                    ln1_Deviation2Edge = []
                    cl1_Deviation2Edge = []
                    db1_Deviation2Edge = []
                    for i in xrange(0,len(xx1_Bracing),3):
                        int0_BracingFromLayerIndex = int(xx1_Bracing[i]) // int0_TrailNumber
                        int0_BracingFromTrailIndex = int(xx1_Bracing[i]) % int0_TrailNumber
                        int0_BracingToLayerIndex = int(xx1_Bracing[i+1]) // int0_TrailNumber
                        int0_BracingToTrailIndex = int(xx1_Bracing[i+1]) % int0_TrailNumber
                        ln0_Deviation2Edge = rh.Line(pt2_GlobNodeIteration[int0_BracingFromLayerIndex][int0_BracingFromTrailIndex],pt2_GlobNodeIteration[int0_BracingToLayerIndex][int0_BracingToTrailIndex])
                        ln1_Deviation2Edge.append(ln0_Deviation2Edge)
                        if float(xx1_Bracing[i+2]) > 0.0:
                            cl1_Deviation2Edge.append(System.Drawing.Color.Red)
                        elif float(xx1_Bracing[i+2]) < 0.0:
                            cl1_Deviation2Edge.append(System.Drawing.Color.Blue)
                        else:
                            cl1_Deviation2Edge.append(System.Drawing.Color.Black)
                        db1_Deviation2Edge.append(xx1_Bracing[i+2])
                        
                        
                    ### OUTPUT
    
                    ln1_GlobExtEdgeOut = ListListToList(ln2_GlobExtEdge)
                    pt1_GlobNodeOut = ListListToList(pt2_GlobNodeIteration)
                    ln1_GlobTrailEdgeOut = ListListToList(ln2_GlobTrailEdge)
                    cl1_GlobTrailEdgeOut = ListListToList(cl2_GlobTrailEdge)
                    db1_GlobTrailEdgeOut = ListListToList(db2_GlobTrailEdge)
                    ln1_GlobDeviation1EdgeOut = ListListToList(ln2_GlobDeviation1Edge)
                    cl1_GlobDeviation1EdgeOut = ListListToList(cl2_GlobDeviation1Edge)
                    db1_GlobDeviation1EdgeOut = ListListToList(db2_GlobDeviation1Edge)
                    ln1_GlobDeviation2EdgeOut = ln1_Deviation2Edge
                    cl1_GlobDeviation2EdgeOut = cl1_Deviation2Edge
                    db1_GlobDeviation2EdgeOut = db1_Deviation2Edge
                    ln1_GlobDeviationEdgeOut = ln1_GlobDeviation1EdgeOut[:]
                    ln1_GlobDeviationEdgeOut.extend(ln1_GlobDeviation2EdgeOut)
                    str1_GlobDeviationEdgeOut = str1_Dev1EdgeID[:]
                    str1_GlobDeviationEdgeOut.extend(str1_Dev2EdgeID)
                    cl1_GlobDeviationEdgeOut = cl1_GlobDeviation1EdgeOut[:]
                    cl1_GlobDeviationEdgeOut.extend(cl1_GlobDeviation2EdgeOut)
                    db1_GlobDeviationEdgeOut = db1_GlobDeviation1EdgeOut[:]
                    db1_GlobDeviationEdgeOut.extend(db1_GlobDeviation2EdgeOut)
                    int1_DevEdgeInputSortID = int1_DevEdgeInputID[:]
                    if len(str1_GlobDeviationEdgeOut) > 0:
                        str1_GlobDeviationEdgeOut, ln1_GlobDeviationEdgeOut, cl1_GlobDeviationEdgeOut, db1_GlobDeviationEdgeOut = (list(t) for t in zip(*sorted(zip(str1_GlobDeviationEdgeOut, ln1_GlobDeviationEdgeOut, cl1_GlobDeviationEdgeOut, db1_GlobDeviationEdgeOut))))
                        int1_DevEdgeInputSortID, ln1_GlobDeviationEdgeOut, str1_GlobDeviationEdgeOut, cl1_GlobDeviationEdgeOut, db1_GlobDeviationEdgeOut = (list(t) for t in zip(*sorted(zip(int1_DevEdgeInputSortID, ln1_GlobDeviationEdgeOut, str1_GlobDeviationEdgeOut, cl1_GlobDeviationEdgeOut, db1_GlobDeviationEdgeOut))))
                    ln1_GlobExtFOEdgeOut = ListListToList(ln2_GlobExtFOEdge)
                    cl1_GlobExtFOEdgeOut = ListListToList(cl2_GlobExtFOEdge)
                    db1_GlobExtFOEdgeOut = ListListToList(db2_GlobExtFOEdge)
                    M.ln1_GlobExtEdgeOut = ln1_GlobExtEdgeOut
                    M.pt1_GlobNodeOut = pt1_GlobNodeOut[:len(str1_NodeOrderC)]
                    M.ln1_GlobTrailEdgeOut = ln1_GlobTrailEdgeOut[:len(str1_TrailEdgeID)]
                    M.str1_GlobTrailEdgeOut = str1_TrailEdgeID
                    M.cl1_GlobTrailEdgeOut = cl1_GlobTrailEdgeOut[:len(str1_TrailEdgeID)]
                    M.db1_GlobTrailEdgeOut = db1_GlobTrailEdgeOut[:len(str1_TrailEdgeID)]
                    M.ln1_GlobDeviation1EdgeOut = ln1_GlobDeviation1EdgeOut
                    M.str1_GlobDeviation1EdgeOut = str1_Dev1EdgeID
                    M.cl1_GlobDeviation1EdgeOut = cl1_GlobDeviation1EdgeOut
                    M.db1_GlobDeviation1EdgeOut = db1_GlobDeviation1EdgeOut
                    M.ln1_GlobDeviation2EdgeOut = ln1_GlobDeviation2EdgeOut
                    M.str1_GlobDeviation2EdgeOut = str1_Dev2EdgeID
                    M.cl1_GlobDeviation2EdgeOut = cl1_GlobDeviation2EdgeOut
                    M.db1_GlobDeviation2EdgeOut = db1_GlobDeviation2EdgeOut
                    M.ln1_GlobDeviationEdgeOut = ln1_GlobDeviationEdgeOut
                    M.str1_GlobDeviationEdgeOut = str1_GlobDeviationEdgeOut
                    M.cl1_GlobDeviationEdgeOut = cl1_GlobDeviationEdgeOut
                    M.db1_GlobDeviationEdgeOut = db1_GlobDeviationEdgeOut
                    M.ln1_GlobExtFOEdgeOut = ln1_GlobExtFOEdgeOut
                    M.cl1_GlobExtFOEdgeOut = cl1_GlobExtFOEdgeOut
                    M.db1_GlobExtFOEdgeOut = db1_GlobExtFOEdgeOut
                    M.str1_NodeOrderOut = str1_NodeOrderC
                    M.str1_EdgeOut = str1_Edge

    global int0_Counter
    int0_Counter = 0
    
    db0_Distance = 0

    if targetNode and targetNodeID:
        db0_DistanceGeometry = 0
        for i in xrange(0,len(targetNodeID)): 
            if str(targetNodeID[i]) in str1_NodeOrderC:
                int0_IndexGlobNode = int(str1_NodeOrderC.index(str(targetNodeID[i])))
                pt0_GlobNode = pt2_GlobNode[int0_IndexGlobNode // int0_TrailNumber - 1][int0_IndexGlobNode % int0_TrailNumber]
                targetNode0 = pt0_GlobNode
                if isinstance(targetNode[i], rh.Curve):
                    targetNode0 = targetNode[i].PointAt( targetNode[i].ClosestPoint(pt0_GlobNode)[1] )
                elif isinstance(targetNode[i], rh.Brep) or isinstance(targetNode[i], rh.BrepFace):
                    targetNode[i] = rs.coercesurface(targetNode[i])
                    targetNode0 = targetNode[i].PointAt( targetNode[i].ClosestPoint(pt0_GlobNode)[1], targetNode[i].ClosestPoint(pt0_GlobNode)[2] )
                elif isinstance(targetNode[i], rh.Point3d):
                    targetNode0 = targetNode[i]
                db0_DistanceGeometry += targetNodeCoeff*pt0_GlobNode.DistanceToSquared(targetNode0)
        db0_Distance += targetNodeCoeff*db0_DistanceGeometry

    if targetVector and targetVectorID:
        db0_DistanceVectorDir = 0
        db0_DistanceVectorMag = 0
        for i in xrange(0,len(targetVectorID)):
            if str(targetVectorID[i]) in str1_NodeOrderC:
                int0_IndexGlobNode = int(str1_NodeOrderC.index(str(targetVectorID[i])))
                vc0_GlobVector = vc2_GlobTrailForce[int0_IndexGlobNode // int0_TrailNumber][int0_IndexGlobNode % int0_TrailNumber]
                targetVector0 = vc0_GlobVector
                if isinstance(targetVector[i], rh.Vector3d):
                    targetVector0 = targetVector[i]
                db0_DistanceVectorMag += (vc0_GlobVector.Length - targetVector0.Length)**2
                vc0_GlobVectorU = rh.Vector3d(vc0_GlobVector)
                targetVector0U = rh.Vector3d(targetVector0)
                vc0_GlobVectorU.Unitize()
                targetVector0U.Unitize()
                db0_DistanceVectorDir += ((1- abs(rh.Vector3d.Multiply(vc0_GlobVectorU,targetVector0U)))**2)
        db0_Distance = db0_Distance + targetVectorCoeffMag*db0_DistanceVectorMag + targetVectorCoeffDir*db0_DistanceVectorDir

    if bl0_Print:
        str0_DescriptionOpt += "\nobjective: " + str(db0_Distance)
        str0_DescriptionOpt += "\n\n\n "
        print str0_DescriptionOpt
    
    global GlobDivergence
    str0_GlobDivergence = str(int(db0_Distance*1E5)/1E5)
    
    if db0_Distance < db0_DistanceBest:
        db0_DistanceBest = db0_Distance
        db1_VariableBest = db1_Variable
        
    return(db0_Distance)

pt2_Trails = []


M = model()



if TPC and hasattr(TPC,"db1_StructuralBehaviourOut"):

    vc2_GlobTrailForce = []
    ln2_GlobExtEdge = []
    pt2_GlobNode = []
    pt2_GlobNodeIteration = []
    ln2_GlobTrailEdge = []
    cl2_GlobTrailEdge = []
    db2_GlobTrailEdge = []
    ln2_GlobDeviation1Edge = []
    cl2_GlobDeviation1Edge = []
    db2_GlobDeviation1Edge = []
    ln2_GlobDeviation2Edge = []
    cl2_GlobDeviation2Edge = []
    db2_GlobDeviation2Edge = []
    ln2_GlobExtFOEdge = []
    cl2_GlobExtFOEdge = []
    db2_GlobExtFOEdge = []
    
    
    db1_StructuralBehaviour = TPC.db1_StructuralBehaviourOut
    str1_NodeOrderC = TPC.str1_NodeOrderOut
    xx1_Bracing = TPC.db1_DeviationIndirectOut
    pl1_ConstraintPlane = TPC.pl1_ConstraintPlaneOut
    id_NodePlane = TPC.int1_ConstraintPlaneOut
    pt1_OriginNode = TPC.pt1_OriginNodeOut
    str1_Edge = TPC.str1_EdgeOut
    
    # Counters and Tolerance
    int0_Counter = 0
    db0_Divergence = float("inf")
    db0_Threshold = 1e-3
    int0_CounterBracing = 50
    db0_DistanceBest = float("inf")
    db1_VariableBest = []

    if len(xx1_Bracing) == 0: int0_CounterBracing = 1

    int0_TrailNumber = len(pt1_OriginNode)  # input nodes
    int0_C = 3+int0_TrailNumber+1
    int0_R = int(len(db1_StructuralBehaviour)/int0_C)
    db2_StructuralBehaviour = ListToListList(db1_StructuralBehaviour, int0_R, int0_C)
    int0_LayerCount = int(len(db2_StructuralBehaviour)/int0_TrailNumber) # amount of layers
    
    
    # Variables for Optimization
    
    # Deviation 1
    int2_Deviation1Edge = []
    db1_Deviation1Edge = []
    for g in xrange(int0_LayerCount):
        k = 3
        for i in xrange(g*int0_TrailNumber,(g+1)*int0_TrailNumber):
            k += 1
            for j in xrange(k,int0_TrailNumber+3):
                if db2_StructuralBehaviour[i][j] != 0:
                    int2_Deviation1Edge.append((i,j))
                    db1_Deviation1Edge.append(db2_StructuralBehaviour[i][j])
    # Trail
    int2_TrailEdge = []
    db1_TrailEdge = []
    for g in xrange(int0_LayerCount-1):
        for i in xrange(int0_TrailNumber):
            int2_TrailEdge.append([g*int0_TrailNumber + i,int0_TrailNumber+3]) 
            db1_TrailEdge.append(db2_StructuralBehaviour[g*int0_TrailNumber + i][int0_TrailNumber+3])

    # Deviation 2
    db1_Deviation2Edge = []
    for i in range(2,len(xx1_Bracing),3):
        db1_Deviation2Edge.append(xx1_Bracing[i])

    # Origin Nodes
    db1_OriginNodeX = [pt0_OriginNode.X for pt0_OriginNode in pt1_OriginNode]
    db1_OriginNodeY = [pt0_OriginNode.Y for pt0_OriginNode in pt1_OriginNode]
    db1_OriginNodeZ = [pt0_OriginNode.Z for pt0_OriginNode in pt1_OriginNode]

    int0_CounterOpt = 0
    print "Iteration report\n\n "

    # Calculate gradient
    def Grad(var, grad):
        if grad:
            global db0_Dx
            fX_0 = Main(db1_StructuralBehaviour, str1_NodeOrderC, xx1_Bracing, pl1_ConstraintPlane, id_NodePlane, pt1_OriginNode, str1_Edge, db0_Divergence, db0_Threshold, int0_CounterBracing, int0_TrailNumber, int0_C, int0_R, db2_StructuralBehaviour, int0_LayerCount, var, False)
            for i in range(len(var)):
                varDx = var[:]
                varDx[i] += db0_Dx
                if db1_BoundUp[i] != db1_BoundLow[i]:
                    fX_1 = Main(db1_StructuralBehaviour, str1_NodeOrderC, xx1_Bracing, pl1_ConstraintPlane, id_NodePlane, pt1_OriginNode, str1_Edge, db0_Divergence, db0_Threshold, int0_CounterBracing, int0_TrailNumber, int0_C, int0_R, db2_StructuralBehaviour, int0_LayerCount, varDx, False)
                    dfX_1 = (fX_1 - fX_0) / db0_Dx
                else: dfX_1 = 0.0 
                grad[i] = dfX_1
        out = Main(db1_StructuralBehaviour, str1_NodeOrderC, xx1_Bracing, pl1_ConstraintPlane, id_NodePlane, pt1_OriginNode, str1_Edge, db0_Divergence, db0_Threshold, int0_CounterBracing, int0_TrailNumber, int0_C, int0_R, db2_StructuralBehaviour, int0_LayerCount, var, True)
        return out

    # Optimization function
    def Optimization(db1_InitialValues, db1_BoundUp, db1_BoundLow, db0_T, int0_I, nl0_Algo):
        solver = nl.NLoptSolver(nl0_Algo, len(db1_InitialValues), db0_T, int0_I)
        solver.SetLowerBounds(Array[float]( db1_BoundLow ))
        solver.SetUpperBounds(Array[float]( db1_BoundUp ))
        solver.SetMinObjective.Overloads[Func[Array[float], Array[float], float]](Grad)
        initialValue = Array[float](db1_InitialValues)
        out, finalScore = solver.Optimize(initialValue)
        return finalScore
    
    global str0_GlobSolver
    str0_GlobSolver = "None"
    
#    if O and (hasattr(O, "targetNode") and hasattr(O, "targetNodeID") or hasattr(O, "targetVector") and hasattr(O, "targetVectorID")):
#        int1_T_ID = O.boundsTrailID
#        db1_T_Up = O.boundsTrailUp
#        db1_T_Low = O.boundsTrailLow
#        
#        int1_D_ID = O.boundsDevID
#        db1_D_Up = O.boundsDevUp
#        db1_D_Low = O.boundsDevLow
#
#        int1_O_ID = O.boundsOriginNodeID
#        db1_O_UpX = O.boundsOriginNodeUpX 
#        db1_O_LowX = O.boundsOriginNodeLowX
#        db1_O_UpY = O.boundsOriginNodeUpY
#        db1_O_LowY = O.boundsOriginNodeLowY
#        db1_O_UpZ = O.boundsOriginNodeUpZ
#        db1_O_LowZ = O.boundsOriginNodeLowZ
#        
#        global db0_Dx
#        db0_Dx = O.gradientDelta
#        db0_T = O.relativeTolerance
#        int0_I = O.maxIterations
#        str0_A = O.optimAlgorithm
#        str0_GlobSolver = str0_A
#
#        dc1_Algo = {"LD_SLSQP" : nl.NLoptAlgorithm.LD_SLSQP,
#                    "LN_BOBYQA" : nl.NLoptAlgorithm.LN_BOBYQA,
#                    "GD_MLSL" : nl.NLoptAlgorithm.GD_MLSL,
#                    "LD_LBFGS" : nl.NLoptAlgorithm.LD_LBFGS,
#                    "LD_AUGLAG" : nl.NLoptAlgorithm.LD_AUGLAG,
#                    "LN_SBPLX" : nl.NLoptAlgorithm.LN_SBPLX,
#                    "LN_COBYLA" : nl.NLoptAlgorithm.LN_COBYLA,
#                    "LD_TNEWTON" : nl.NLoptAlgorithm.LD_TNEWTON,
#                    "GN_ISRES" : nl.NLoptAlgorithm.GN_ISRES,
#                    "GN_MLSL" : nl.NLoptAlgorithm.GN_MLSL}
#
#
#        db1_TrailBoundUp = db1_TrailEdge[:]
#
#        for i in range(len(int1_T_ID)):
#            if str(int1_T_ID[i]) in str1_TrailEdgeID: db1_TrailBoundUp[ str1_TrailEdgeID.index(str(int1_T_ID[i])) ] += db1_T_Up[i]
#        db1_TrailBoundLow = db1_TrailEdge[:]
#        for i in range(len(int1_T_ID)):
#            if str(int1_T_ID[i]) in str1_TrailEdgeID: db1_TrailBoundLow[ str1_TrailEdgeID.index(str(int1_T_ID[i])) ] += db1_T_Low[i]
#
#        db1_Deviation1BoundUp = db1_Deviation1Edge[:]
#        for i in range(len(int1_D_ID)):
#            if str(int1_D_ID[i]) in str1_Dev1EdgeID: db1_Deviation1BoundUp[ str1_Dev1EdgeID.index(str(int1_D_ID[i])) ] += db1_D_Up[i]
#        db1_Deviation1BoundLow = db1_Deviation1Edge[:]
#        for i in range(len(int1_D_ID)):
#           if str(int1_D_ID[i]) in str1_Dev1EdgeID: db1_Deviation1BoundLow[ str1_Dev1EdgeID.index(str(int1_D_ID[i])) ] += db1_D_Low[i]
#
#        db1_Deviation2BoundUp = db1_Deviation2Edge[:]
#        for i in range(len(int1_D_ID)):
#            if str(int1_D_ID[i]) in str1_Dev2EdgeID: db1_Deviation2BoundUp[ str1_Dev2EdgeID.index(str(int1_D_ID[i])) ] += db1_D_Up[i]
#        db1_Deviation2BoundLow = db1_Deviation2Edge[:]
#        for i in range(len(int1_D_ID)):
#            if str(int1_D_ID[i]) in str1_Dev2EdgeID: db1_Deviation2BoundLow[ str1_Dev2EdgeID.index(str(int1_D_ID[i])) ] += db1_D_Low[i]
#
#        db1_OriginNodeXBoundUp = db1_OriginNodeX[:]
#        str1_OriginNode = str1_NodeOrderC[:len(pt1_OriginNode)]
#        for i in range(len(str1_OriginNode)):
#            str1_OriginNode[i] = str1_OriginNode[i].replace("L","")
#
#        for i in range(len(int1_O_ID)):
#            if str(int1_O_ID[i]) in str1_OriginNode: db1_OriginNodeXBoundUp[ str1_OriginNode.index(str(int1_O_ID[i])) ] += db1_O_UpX[i]
#        db1_OriginNodeXBoundLow = db1_OriginNodeX[:]
#        for i in range(len(int1_O_ID)):
#            if str(int1_O_ID[i]) in str1_OriginNode: db1_OriginNodeXBoundLow[ str1_OriginNode.index(str(int1_O_ID[i])) ] += db1_O_LowX[i]
#        db1_OriginNodeYBoundUp = db1_OriginNodeY[:]
#        for i in range(len(int1_O_ID)):
#            if str(int1_O_ID[i]) in str1_OriginNode: db1_OriginNodeYBoundUp[ str1_OriginNode.index(str(int1_O_ID[i])) ] += db1_O_UpY[i]
#        db1_OriginNodeYBoundLow = db1_OriginNodeY[:]
#        for i in range(len(int1_O_ID)):
#            if str(int1_O_ID[i]) in str1_OriginNode: db1_OriginNodeYBoundLow[ str1_OriginNode.index(str(int1_O_ID[i])) ] += db1_O_LowY[i]
#        db1_OriginNodeZBoundUp = db1_OriginNodeZ[:]
#        for i in range(len(int1_O_ID)):
#            if str(int1_O_ID[i]) in str1_OriginNode: db1_OriginNodeZBoundUp[ str1_OriginNode.index(str(int1_O_ID[i])) ] += db1_O_UpZ[i]
#        db1_OriginNodeZBoundLow = db1_OriginNodeZ[:]
#        for i in range(len(int1_O_ID)):
#            if str(int1_O_ID[i]) in str1_OriginNode: db1_OriginNodeZBoundLow[ str1_OriginNode.index(str(int1_O_ID[i])) ] += db1_O_LowZ[i]
#
#        # Define Initial Values for Optimization
#        db1_InitialValues = []
#        db1_InitialValues = db1_Deviation1Edge[:]
#        db1_InitialValues.extend(db1_TrailEdge[:])
#        db1_InitialValues.extend(db1_Deviation2Edge[:])
#        db1_InitialValues.extend(db1_OriginNodeX[:])
#        db1_InitialValues.extend(db1_OriginNodeY[:])
#        db1_InitialValues.extend(db1_OriginNodeZ[:])
#
#        # Define Bounds for Optimization
#        db1_BoundUp = []
#        db1_BoundUp = db1_Deviation1BoundUp[:]
#        db1_BoundUp.extend(db1_TrailBoundUp[:])
#        db1_BoundUp.extend(db1_Deviation2BoundUp[:])
#        db1_BoundUp.extend(db1_OriginNodeXBoundUp[:])
#        db1_BoundUp.extend(db1_OriginNodeYBoundUp[:])
#        db1_BoundUp.extend(db1_OriginNodeZBoundUp[:])
#        db1_BoundLow = []
#        db1_BoundLow = db1_Deviation1BoundLow[:]
#        db1_BoundLow.extend(db1_TrailBoundLow[:])
#        db1_BoundLow.extend(db1_Deviation2BoundLow[:])
#        db1_BoundLow.extend(db1_OriginNodeXBoundLow[:])
#        db1_BoundLow.extend(db1_OriginNodeYBoundLow[:])
#        db1_BoundLow.extend(db1_OriginNodeZBoundLow[:])
#
#        Optimization(db1_InitialValues, db1_BoundUp, db1_BoundLow, db0_T, int0_I, dc1_Algo[str0_A])
#        
#        Main(db1_StructuralBehaviour, str1_NodeOrderC, xx1_Bracing, pl1_ConstraintPlane, id_NodePlane, pt1_OriginNode, str1_Edge, db0_Divergence, db0_Threshold, int0_CounterBracing, int0_TrailNumber, int0_C, int0_R, db2_StructuralBehaviour, int0_LayerCount, db1_VariableBest, True)
#    else:
    Main(db1_StructuralBehaviour, str1_NodeOrderC, xx1_Bracing, pl1_ConstraintPlane, id_NodePlane, pt1_OriginNode, str1_Edge, db0_Divergence, db0_Threshold, int0_CounterBracing, int0_TrailNumber, int0_C, int0_R, db2_StructuralBehaviour, int0_LayerCount, [], True)
# ---------- end cem_calculate_structure ----------

# ---- group: visualize equilibrium structure
pipe_scale = Slider(0.027, range=0.01..0.1)
minimum_thickness = Slider(0.18, range=0.1..0.5)
compression_penalty_factor = Slider(1.9, range=1..3)
cem_extract_structure = PythonScript(M=cem_calculate_structure)  # -> nodes, nodesID, trails, trailsID, trailsCol, trailsMag, deviations, deviationsID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
# ---------- cem_extract_structure: Python ----------
"""
Retrieves automatically the data in the structural model
    Inputs:
        M: (structural model) The calculated structural model (empty on error)
    Outputs:
        nodes: (point3D) The nodes of the structural model
        nodesID: (string) The IDs of the nodes
        trails: (line) The trail edges of the structural model
        trailsID: (string) The IDs of the trail edges
        trailsCol: (color) The colors of the trail edges
        trailsMag: (double) The magnitudes of the forces in the trail edges
        deviationDirect: (line) The direct deviation edges of the structural model
        deviationsDirectID: (string) The IDs of the direct deviation edges
        deviationDirectCol: (color) The colors of the direct deviation edges
        deviationDirectMag: (double) The magnitudes of the forces in the direct deviation edges
        deviationIndirect: (line) The indirect deviation edges of the structural model
        deviationsIndirectID: (string) The IDs of the indirect deviation edges
        deviationIndirectCol: (color) The colors of the indirect deviation edges
        deviationIndirectMag: (double) The magnitudes of the forces in the indirect deviation edges
        externalForces: (line) The external forces of the structural model
        externalForcesCol: (color) The colors of the external forces 
        externalForcesMag: (double) The magnitudes of the forces in the external forces 
    Remarks:
        This extract the data within the structural diagram
"""


if M and hasattr(M, "pt1_GlobNodeOut") and hasattr(M, "str1_NodeOrderOut") and hasattr(M, "ln1_GlobTrailEdgeOut") and hasattr(M, "cl1_GlobTrailEdgeOut") and hasattr(M, "db1_GlobTrailEdgeOut") and hasattr(M, "ln1_GlobDeviation1EdgeOut") and hasattr(M, "cl1_GlobDeviation1EdgeOut") and hasattr(M, "db1_GlobDeviation1EdgeOut") and hasattr(M, "ln1_GlobDeviation2EdgeOut") and hasattr(M, "cl1_GlobDeviation2EdgeOut") and hasattr(M, "db1_GlobDeviation2EdgeOut") and hasattr(M, "ln1_GlobExtFOEdgeOut") and hasattr(M, "cl1_GlobExtFOEdgeOut") and hasattr(M, "db1_GlobExtFOEdgeOut"):

    nodes_C = []
    nodesID_C = []
    for i in range(len(M.pt1_GlobNodeOut)):
        if M.str1_NodeOrderOut[i][0] != "L":
            nodes_C.append(M.pt1_GlobNodeOut[i])
            nodesID_C.append(M.str1_NodeOrderOut[i])
        nodes = nodes_C
        nodesID = nodesID_C
        
    trails_C = []
    trailsID_C = []
    trailsCol_C = []
    trailsMag_C = []
    for i in range(len(M.ln1_GlobTrailEdgeOut)):
        if M.str1_GlobTrailEdgeOut[i][0] != "E":
            trails_C.append(M.ln1_GlobTrailEdgeOut[i])
            trailsID_C.append(M.str1_GlobTrailEdgeOut[i])
            trailsCol_C.append(M.cl1_GlobTrailEdgeOut[i])
            trailsMag_C.append(M.db1_GlobTrailEdgeOut[i])
        trails = trails_C
        trailsID = trailsID_C
        trailsCol = trailsCol_C
        trailsMag = trailsMag_C
        
    deviationsDirect = M.ln1_GlobDeviation1EdgeOut
    deviationsDirectID = M.str1_GlobDeviation1EdgeOut
    deviationsDirectCol = M.cl1_GlobDeviation1EdgeOut
    deviationsDirectMag = M.db1_GlobDeviation1EdgeOut
    deviationsIndirect = M.ln1_GlobDeviation2EdgeOut
    deviationsIndirectID = M.str1_GlobDeviation2EdgeOut
    deviationsIndirectCol = M.cl1_GlobDeviation2EdgeOut
    deviationsIndirectMag = M.db1_GlobDeviation2EdgeOut
    deviations = M.ln1_GlobDeviationEdgeOut
    deviationsID = M.str1_GlobDeviationEdgeOut
    deviationsCol = M.cl1_GlobDeviationEdgeOut
    deviationsMag = M.db1_GlobDeviationEdgeOut
    externalForces = M.ln1_GlobExtFOEdgeOut
    externalForcesCol = M.cl1_GlobExtFOEdgeOut
    externalForcesMag = M.db1_GlobExtFOEdgeOut
# ---------- end cem_extract_structure ----------
abs = Absolute(Value=cem_extract_structure.trailsMag)
abs_2 = Absolute(Value=cem_extract_structure.deviationsMag)
smaller = SmallerThan(FirstNumber=cem_extract_structure.trailsMag, SecondNumber=0)  # -> SmallerThan, OrEqualTo
smaller_2 = SmallerThan(FirstNumber=cem_extract_structure.deviationsMag, SecondNumber=0)  # -> SmallerThan, OrEqualTo
subtraction_5 = Subtraction(A=1, B=smaller.SmallerThan)
multiplication = Multiplication(A=smaller.SmallerThan, B=compression_penalty_factor)
subtraction_6 = Subtraction(A=1, B=smaller_2.SmallerThan)
multiplication_2 = Multiplication(A=smaller_2.SmallerThan, B=compression_penalty_factor)
addition_10 = Addition(A=subtraction_5, B=multiplication)
addition_11 = Addition(A=subtraction_6, B=multiplication_2)
multiplication_3 = Multiplication(A=pipe_scale, B=addition_10, C=cem_extract_structure.trailsMag)
multiplication_4 = Multiplication(A=pipe_scale, B=addition_11, C=abs_2)
max = Maximum(A=multiplication_3, B=minimum_thickness)
max_2 = Maximum(A=multiplication_4, B=minimum_thickness)
pipe = Pipe(Curve=cem_extract_structure.trails, Radius=max, Caps=2)  # -> flatten(Pipe)
pipe_2 = Pipe(Curve=cem_extract_structure.deviations, Radius=max_2, Caps=2)  # -> flatten(Pipe)
merge_6 = Merge(Data1=pipe, Data2=pipe_2)
merge_7 = Merge(Data1=cem_extract_structure.trailsCol, Data2=cem_extract_structure.deviationsCol)
preview = CustomPreview(Geometry=merge_6, Material=merge_7)

# ---- group: compute load path
compression_penalty_factor_2 = Slider(1, range=1..3)
smaller_3 = SmallerThan(FirstNumber=cem_extract_structure.trailsMag, SecondNumber=0)  # -> SmallerThan, OrEqualTo
smaller_4 = SmallerThan(FirstNumber=cem_extract_structure.deviationsMag, SecondNumber=0)  # -> SmallerThan, OrEqualTo
subtraction_7 = Subtraction(A=1, B=smaller_4.SmallerThan)
multiplication_5 = Multiplication(A=smaller_4.SmallerThan, B=compression_penalty_factor_2)
subtraction_8 = Subtraction(A=1, B=smaller_3.SmallerThan)
multiplication_6 = Multiplication(A=smaller_3.SmallerThan, B=compression_penalty_factor_2)
addition_12 = Addition(A=subtraction_7, B=multiplication_5)
addition_13 = Addition(A=subtraction_8, B=multiplication_6)
len = Length(Curve=cem_extract_structure.trails)
len_2 = Length(Curve=cem_extract_structure.deviations)
multiplication_7 = Multiplication(A=len, B=abs, C=addition_13)
multiplication_8 = Multiplication(A=len_2, B=abs_2, C=addition_12)
ma = MassAddition(Input=multiplication_7)  # -> Result, PartialResults
ma_2 = MassAddition(Input=multiplication_8)  # -> Result, PartialResults
addition_14 = Addition(A=ma.Result, B=ma_2.Result)
load_path = Number(addition_14)
panel_7 = Panel(load_path)

# ---- group: compute maximum deck inclination
split = TextSplit(Text=cem_extract_structure.trailsID, Separators="T")
item_2 = ListItem(List=split, Index=1, Wrap=True)  # -> flatten(Item)
larger = LargerThan(FirstNumber=item_2, SecondNumber=31)  # -> LargerThan, OrEqualTo
smaller_5 = SmallerThan(FirstNumber=item_2, SecondNumber=60)  # -> SmallerThan, OrEqualTo
and = GateAnd(A=larger.LargerThan, B=smaller_5.SmallerThan)
dispatch = Dispatch(List=cem_extract_structure.trails, DispatchPattern=and)  # -> ListA, ListB
xz = XZPlane(Origin=Point(0, 0, 0))
X = UnitX(Factor=1)
X_2 = UnitX(Factor=-1)
angle = Angle(VectorA=dispatch.ListA, VectorB=X, Plane=xz)  # -> Angle, Reflex
angle_2 = Angle(VectorA=dispatch.ListA, VectorB=X_2, Plane=xz)  # -> Angle, Reflex
min = Minimum(A=angle_2.Angle, B=angle_2.Reflex)
min_2 = Minimum(A=angle.Angle, B=angle.Reflex)
min_3 = Minimum(A=min_2, B=min)
pi = Pi(Factor=1)
division = Division(A=min_3, B=pi)
multiplication_9 = Multiplication(A=division, B=180)
sort_2 = SortList(Keys=multiplication_9)  # -> Keys, ValuesA
item_3 = ListItem(List=sort_2.Keys, Index=-1, Wrap=True)
maximum_deck_inclination = Number(item_3)
panel_8 = Panel(maximum_deck_inclination)

# ---- group: assemble connectivity matrix
trails = Line(cem_extract_structure.trails)
deviations = Line(cem_extract_structure.deviations)
nodes = Point(cem_extract_structure.nodes)
lines = Merge(Data1=trails, Data2=deviations)
eval = EvaluateCurve(Curve=lines, Parameter=0.5)  # -> Point, Tangent, Angle
cluster = Cluster(S=nodes, C=lines)  # -> S_2, out
lng = ListLength(List=eval.Point)
series = Series(Start=0, Step=1, Count=lng)
partition = PartitionList(List=cluster.out, Size=2)
panel_9 = Panel(partition)
tag = TextTag(Location=nodes, Text=cluster.S_2)
tag_2 = TextTag(Location=eval.Point, Text=series)

# ---- group: collect data
merge_8 = Merge(
    Data1=cable_center_deviation_force,
    Data2=deck_center_deviation_force,
    Data3=hangar_force_2,
    Data4=deck_deviation_force,
    Data5=cable_deviation_force,
    Data6=tower_force,
    Data7=tower_brace_force,
    Data8=deck_rise,
    Data9=cable_deck_midspan_distance,
    Data10=tower_base_x_offset,
    Data11=tower_base_y_offset,
    Data12=twist_offset)
lng_2 = ListLength(List=cem_extract_structure.nodes)
lng_3 = ListLength(List=cem_extract_structure.trails)
lng_4 = ListLength(List=cem_extract_structure.deviations)
pdecon_4 = Deconstruct(Point=cem_extract_structure.nodes)  # -> XComponent, YComponent, ZComponent
len_3 = Length(Curve=cem_extract_structure.trails)
len_4 = Length(Curve=cem_extract_structure.deviations)
maximum_deck_inclination_2 = Number(maximum_deck_inclination)
filter_13 = StreamFilter(Gate=list, Stream0=merge_8, Stream1=merge_2, Stream2=merge_3)
load_path_2 = Number(load_path)
devmag = Number(cem_extract_structure.deviationsMag)
nn = Integer(lng_2)
nt = Integer(lng_3)
nd = Integer(lng_4)
loady = Number(panel_2)
posx = Number(pdecon_4.XComponent)
posz = Number(pdecon_4.ZComponent)
tralen = Number(len_3)
tramag = Number(cem_extract_structure.trailsMag)
devlen = Number(len_4)
loadx = Number(panel)
loadz = Number(panel_3)
posy = Number(pdecon_4.YComponent)

# ----
entwine = Entwine(
    Branch00=filter_13,
    Branch01=nn,
    Branch02=nt,
    Branch03=nd,
    Branch04=loadx,
    Branch05=loady,
    Branch06=loadz,
    Branch07=posx,
    Branch08=posy,
    Branch09=posz,
    Branch010=tralen,
    Branch011=tramag,
    Branch012=devlen,
    Branch013=devmag,
    Branch014=load_path_2,
    Branch015=maximum_deck_inclination_2,
    FlattenInputs=True)  # -> flatten(Result)

# ---- group: collect data (continued)
panel_10 = Panel(entwine)

# ---- group: record dataset
data_to_csv = GhPythonScript(x=entwine, file_name="240731_data_00_CEM.csv")  # inputs x: list; disabled
# ---------- data_to_csv: Python ----------
import os
import csv
import rhinoscriptsyntax as rs

with open(os.path.join(rs.DocumentPath(), 'Data' , file_name), "a") as csvfile1:
    if not None in x:
        if len(x) != 0:
            writer = csv.writer(csvfile1, delimiter=',')
            writer.writerow(x)
# ---------- end data_to_csv ----------
data_to_csv_2 = GhPythonScript(y=cluster.out, file_name="240731_data_00_branch-node_CEM.csv")  # inputs y: list; disabled
# ---------- data_to_csv_2: Python ----------
import os
import csv
import rhinoscriptsyntax as rs

with open(os.path.join(rs.DocumentPath(), 'Data' , file_name), "w") as csvfile1:
    
    if not None in y:
        if len(y) != 0 :
            writer = csv.writer(csvfile1, delimiter=',')
            writer.writerow(y)
# ---------- end data_to_csv_2 ----------

# ==== cluster Cluster
S = ClusterInput()
C = ClusterInput()
lng = ListLength(List=S)
end = EndPoints(Curve=C)  # -> Start, End
panel = Panel(end.Start)
series = Series(Start=0, Step=1, Count=lng)
fsim = FindSimilarMember(Data=end.Start, Set=S)  # -> Hit, Index
python = GhPythonScript(x=S, y=end.Start, z=end.End)  # -> out, a; inputs x: list of Point3d, y: list of Point3d, z: list of Point3d
# ---------- python: Python ----------
__author__ = "bertagnf"
__version__ = "2021.04.13"

import rhinoscriptsyntax as rs

allp = x
startp = y
endp = z

for i in range(0, len(startp)):
    if startp[i] in allp and endp[i] in allp:
        print allp.index(startp[i])
        print allp.index(endp[i])
# ---------- end python ----------
fsim_2 = FindSimilarMember(Data=end.End, Set=S)  # -> Hit, Index
S_2 = ClusterOutput(series)
merge = Merge(Data1=graft(fsim.Index), Data2=graft(fsim_2.Index))  # -> flatten(Result)
panel_2 = Panel(python.out)
panel_3 = Panel(merge)
out = ClusterOutput(python.out)
