# Grasshopper definition CEM_Zurich_Bridge_R8_CEM2.gh (Grasshopper 1.0.8)
# plug-ins: RhinoCodePluginGH, CEM_Trail_2.0, CEM_Deviation_2.0, CEM_Build_Topology_2.0, CEM_Calculate_Structure_2.0, CEM_Origin_Node_2.0, CEM_Constraint_Plane_2.0, CEM_Support_2.0, CEM_Extract_Structure_2.0, CEM_Extract_Topology_2.0, CEM_Load_2.0

# ---- group: input parameter selection
load_input = Python3Script(index="0", file_name="240731_data_00_CEM.csv")  # -> cable_center_deviation_force, deck_center_deviation_force, hangar_force, deck_deviation_force, cable_deviation_force, tower_force, tower_brace_force, deck_rise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
# ---------- load_input: Python ----------
import os
import csv
import rhinoscriptsyntax as rs

with open(os.path.join(rs.DocumentPath(), 'Data' , file_name)) as csvfile:
    reader = csv.reader(csvfile, delimiter=',', quoting=csv.QUOTE_NONNUMERIC)
    data = [row for row in reader if row != []]
    (
        cable_center_deviation_force, deck_center_deviation_force, hangar_force, deck_deviation_force,
        cable_deviation_force, tower_force, tower_brace_force, deck_rise, cable_deck_midspan_distance,
        tower_base_x_offset, tower_base_y_offset, twist_offset
    ) = data[int(index)][0:12]
    print(cable_center_deviation_force)
# ---------- end load_input ----------
trigger = Trigger(Interval=10, TimerInterval=10, Target=generate_random_input)  # disabled
generate_random_input = Python3Script()  # -> cable_center_deviation_force, deck_center_deviation_force, hangar_force, deck_deviation_force, cable_deviation_force, tower_force, tower_brace_force, deck_rise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
# ---------- generate_random_input: Python ----------
import random
cable_center_deviation_force = random.uniform(10.0, 20.0)
hangar_force = random.uniform(0.95, 0.98)
cable_deviation_force = random.uniform(-0.1, 0.2)
deck_deviation_force = random.uniform(-0.2, 0.1)
tower_force = random.uniform(-30.0, -20.0)
tower_brace_force = random.uniform(-5.0, 0.0)
deck_rise = random.uniform(2.0, 6.0)
cable_deck_midspan_distance = random.uniform(0.1, 2.0)
tower_base_x_offset = random.uniform(0.0, 20.0)
tower_base_y_offset = random.uniform(0.0, 5.0)
twist_offset = 0
deck_center_deviation_force = random.uniform(-3.0, -1.5)
# ---------- end generate_random_input ----------
list = ValueList({"Slider input": "0", "Random input": "1", "Data input": "2"}, selected="Slider input")
merge = Merge(
    Data1=generate_random_input.cable_center_deviation_force,
    Data2=generate_random_input.deck_center_deviation_force,
    Data3=generate_random_input.hangar_force,
    Data4=generate_random_input.deck_deviation_force,
    Data5=generate_random_input.cable_deviation_force,
    Data6=generate_random_input.tower_force,
    Data7=generate_random_input.tower_brace_force,
    Data8=generate_random_input.deck_rise,
    Data9=generate_random_input.cable_deck_midspan_distance,
    Data10=generate_random_input.tower_base_x_offset,
    Data11=generate_random_input.tower_base_y_offset,
    Data12=generate_random_input.twist_offset)
merge_2 = Merge(
    Data1=load_input.cable_center_deviation_force,
    Data2=load_input.deck_center_deviation_force,
    Data3=load_input.hangar_force,
    Data4=load_input.deck_deviation_force,
    Data5=load_input.cable_deviation_force,
    Data6=load_input.tower_force,
    Data7=load_input.tower_brace_force,
    Data8=load_input.deck_rise,
    Data9=load_input.cable_deck_midspan_distance,
    Data10=load_input.tower_base_x_offset,
    Data11=load_input.tower_base_y_offset,
    Data12=load_input.twist_offset)

# ---- group: create topology diagram / define trail edges
towers = Curve([<curve referenced from the Rhino model> x4])
supporting_spans = Curve([<curve referenced from the Rhino model> x32])
deck = Curve([<curve referenced from the Rhino model> x28])
cem_trail_2_0 = CEM_Trail_20(TrailEdge=towers)
cem_trail_2_0_2 = CEM_Trail_20(TrailEdge=deck)
cem_trail_2_0_3 = CEM_Trail_20(TrailEdge=supporting_spans)
merge_3 = Merge(Data1=cem_trail_2_0_3, Data2=cem_trail_2_0_2, Data3=cem_trail_2_0)

# ---- group: create topology diagram / define deviation edges
cable_center_deviation_force = Slider(13.757, range=10..20)
hangar_force = Curve([<curve referenced from the Rhino model> x28])
cable_center_deviations = Curve([<curve referenced from the Rhino model> x2])
deck_center_deviations = Curve([<curve referenced from the Rhino model> x2])
deck_center_deviation_force = Slider(-2.117, range=-3..-1.5)
hangar_force_2 = Slider(0.967, range=0.95..0.98)
deck_deviations = Curve([<curve referenced from the Rhino model> x14])
deck_deviation_force = Slider(-0.003, range=-0.2..0.1)
cable_deviations = Curve([<curve referenced from the Rhino model> x14])
cable_deviation_force = Slider(0.008, range=-0.1..0.2)
tower_deviations = Curve([<curve referenced from the Rhino model> x4])
tower_force = Slider(-19.969, range=-25..-15)
tower_braces = Curve([<curve referenced from the Rhino model> x2])
tower_brace_force = Slider(-2.646, range=-5..0)
filter = StreamFilter(
    Gate=list,
    Stream0=cable_center_deviation_force,
    Stream1=generate_random_input.cable_center_deviation_force,
    Stream2=load_input.cable_center_deviation_force)
filter_2 = StreamFilter(
    Gate=list,
    Stream0=deck_center_deviation_force,
    Stream1=generate_random_input.deck_center_deviation_force,
    Stream2=load_input.deck_center_deviation_force)
filter_3 = StreamFilter(Gate=list, Stream0=hangar_force_2, Stream1=generate_random_input.hangar_force, Stream2=load_input.hangar_force)
filter_4 = StreamFilter(
    Gate=list,
    Stream0=deck_deviation_force,
    Stream1=generate_random_input.deck_deviation_force,
    Stream2=load_input.deck_deviation_force)
filter_5 = StreamFilter(
    Gate=list,
    Stream0=cable_deviation_force,
    Stream1=generate_random_input.cable_deviation_force,
    Stream2=load_input.cable_deviation_force)
filter_6 = StreamFilter(Gate=list, Stream0=tower_force, Stream1=generate_random_input.tower_force, Stream2=load_input.tower_force)
filter_7 = StreamFilter(
    Gate=list,
    Stream0=tower_brace_force,
    Stream1=generate_random_input.tower_brace_force,
    Stream2=load_input.tower_brace_force)
cem_deviation_2_0 = CEM_Deviation_20(DeviationEdge=tower_deviations, DeviationMagn=filter_6)
cem_deviation_2_0_2 = CEM_Deviation_20(DeviationEdge=cable_deviations, DeviationMagn=filter_5)
cem_deviation_2_0_3 = CEM_Deviation_20(DeviationEdge=tower_braces, DeviationMagn=filter_7)
cem_deviation_2_0_4 = CEM_Deviation_20(DeviationEdge=cable_center_deviations, DeviationMagn=filter)
cem_deviation_2_0_5 = CEM_Deviation_20(DeviationEdge=hangar_force, DeviationMagn=filter_3)
cem_deviation_2_0_6 = CEM_Deviation_20(DeviationEdge=deck_deviations, DeviationMagn=filter_4)
cem_deviation_2_0_7 = CEM_Deviation_20(DeviationEdge=deck_center_deviations, DeviationMagn=filter_2)
merge_4 = Merge(
    Data1=cem_deviation_2_0_4,
    Data2=cem_deviation_2_0_7,
    Data3=cem_deviation_2_0_5,
    Data4=cem_deviation_2_0_6,
    Data5=cem_deviation_2_0_2,
    Data6=cem_deviation_2_0,
    Data7=cem_deviation_2_0_3)

# ---- group: create topology diagram / define support points
support_poirnts = Point([<point referenced from the Rhino model> x12])
cem_support_2_0 = CEM_Support_20(Support=support_poirnts)

# ---- group: create topology diagram / set external loads
deck_points = Point([<point referenced from the Rhino model> x28])
panel = Panel("0")
panel_2 = Panel("0")
panel_3 = Panel("-1")
cem_load_2_0 = CEM_Load_20(PointLoad=deck_points, LoadMagnX=panel, LoadMagnY=panel_2, LoadMagnZ=panel_3)

# ---- group: create topology diagram
cem_build_topology_2_0 = CEM_Build_Topology_20(T=merge_3, L=cem_load_2_0, D=merge_4, S=cem_support_2_0)

# ---- group: calculate equilibrium structure with CEM
cem_extract_topology_2_0 = CEM_Extract_Topology_20(TP=cem_build_topology_2_0)  # -> Nodes, NodesID, Trails, TrailsID, Deviations, DeviationsID, AuxTrails, AuxTrailsID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

# ---- group: calculate equilibrium structure with CEM / Set constaint planes
deplane = DeconstructPlane(Plane=cem_extract_topology_2_0.ConstraintPlane)  # -> Origin, XAxis, YAxis, ZAxis
xy = XYPlane(Origin=Point(0, 0, 0))
sort_pt = SortPoints(Points=deplane.Origin)  # -> Points, Indices
panel_4 = Panel("""0
1
2
4
5
7
-1
-2
-3
-5
-6
-8""")
item = ListItem(List=sort_pt.Indices, Index=panel_4, Wrap=True)  # -> flatten(Item)
replace = ReplaceItems(List=cem_extract_topology_2_0.ConstraintPlane, Item=xy, Indices=item, Wrap=False)
cem_constraint_plane_2_0 = CEM_Constraint_Plane_20(ConstraintPlane=replace, ConstraintPlaneID=cem_extract_topology_2_0.ConstraintPlaneID)

# ---- group: calculate equilibrium structure with CEM / set origin node coordinates
twist_offset = Slider(0, range=0..0.5)
deck_rise = Slider(4.16, range=2..6)
tower_base_x_offset = Slider(7.353, range=0..20)
tower_base_y_offset = Slider(7.832, range=0..10)
cable_deck_midspan_distance = Slider(1.449, range=0.1..2)
sort_pt_2 = SortPoints(Points=cem_extract_topology_2_0.OriginNode)  # -> Points, Indices
bang = ExplodeTree(Data=graft(sort_pt_2.Points))  # -> Branch0, Branch1, Branch2, Branch3, Branch4, Branch5, Branch6, Branch7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
pdecon = Deconstruct(Point=bang.Branch2)  # -> XComponent, YComponent, ZComponent
pdecon_2 = Deconstruct(Point=bang.Branch3)  # -> XComponent, YComponent, ZComponent
pdecon_3 = Deconstruct(Point=bang.Branch11)  # -> XComponent, YComponent, ZComponent
subtraction = Subtraction(A=0.1, B=pdecon_3.ZComponent)
subtraction_2 = Subtraction(A=pdecon_2.ZComponent, B=pdecon.ZComponent)
filter_8 = StreamFilter(Gate=list, Stream0=deck_rise, Stream1=generate_random_input.deck_rise, Stream2=load_input.deck_rise)
filter_9 = StreamFilter(Gate=list, Stream0=twist_offset, Stream1=generate_random_input.twist_offset, Stream2=load_input.twist_offset)
filter_10 = StreamFilter(
    Gate=list,
    Stream0=tower_base_y_offset,
    Stream1=generate_random_input.tower_base_y_offset,
    Stream2=load_input.tower_base_y_offset)
filter_11 = StreamFilter(
    Gate=list,
    Stream0=tower_base_x_offset,
    Stream1=generate_random_input.tower_base_x_offset,
    Stream2=load_input.tower_base_x_offset)
filter_12 = StreamFilter(
    Gate=list,
    Stream0=cable_deck_midspan_distance,
    Stream1=generate_random_input.cable_deck_midspan_distance,
    Stream2=load_input.cable_deck_midspan_distance)
subtraction_3 = Subtraction(A=filter_8, B=pdecon.ZComponent)
subtraction_4 = Subtraction(A=subtraction_3, B=subtraction_2)
neg = Negative(Value=filter_9)
neg_2 = Negative(Value=filter_11)
neg_3 = Negative(Value=filter_10)
addition = Addition(A=subtraction_4, B=filter_12)
Y = UnitY(Factor=-100)
vec = VectorXYZ(XComponent=0, YComponent=filter_9, ZComponent=subtraction_3)  # -> Vector, Length
vec_2 = VectorXYZ(XComponent=0, YComponent=neg, ZComponent=subtraction_3)  # -> Vector, Length
vec_3 = VectorXYZ(XComponent=0, YComponent=filter_9, ZComponent=addition)  # -> Vector, Length
vec_4 = VectorXYZ(XComponent=0, YComponent=neg, ZComponent=addition)  # -> Vector, Length
vec_5 = VectorXYZ(XComponent=filter_11, YComponent=filter_10, ZComponent=subtraction)  # -> Vector, Length
vec_6 = VectorXYZ(XComponent=neg_2, YComponent=filter_10, ZComponent=subtraction)  # -> Vector, Length
vec_7 = VectorXYZ(XComponent=filter_11, YComponent=neg_3, ZComponent=subtraction)  # -> Vector, Length
vec_8 = VectorXYZ(XComponent=neg_2, YComponent=neg_3, ZComponent=subtraction)  # -> Vector, Length
addition_2 = Addition(A=vec.Vector, B=Y)
move = Move(Geometry=bang.Branch6, Motion=addition_2)  # -> Geometry, Transform
move_2 = Move(Geometry=bang.Branch8, Motion=addition_2)  # -> Geometry, Transform
addition_3 = Addition(A=vec_2.Vector, B=Y)
move_3 = Move(Geometry=bang.Branch2, Motion=addition_3)  # -> Geometry, Transform
move_4 = Move(Geometry=bang.Branch4, Motion=addition_3)  # -> Geometry, Transform
addition_4 = Addition(A=vec_3.Vector, B=Y)
move_5 = Move(Geometry=bang.Branch3, Motion=addition_4)  # -> Geometry, Transform
move_6 = Move(Geometry=bang.Branch5, Motion=addition_4)  # -> Geometry, Transform
addition_5 = Addition(A=vec_4.Vector, B=Y)
move_7 = Move(Geometry=bang.Branch7, Motion=addition_5)  # -> Geometry, Transform
move_8 = Move(Geometry=bang.Branch9, Motion=addition_5)  # -> Geometry, Transform
addition_6 = Addition(A=vec_5.Vector, B=Y)
move_9 = Move(Geometry=bang.Branch11, Motion=addition_6)  # -> Geometry, Transform
addition_7 = Addition(A=vec_6.Vector, B=Y)
move_10 = Move(Geometry=bang.Branch1, Motion=addition_7)  # -> Geometry, Transform
addition_8 = Addition(A=vec_7.Vector, B=Y)
move_11 = Move(Geometry=bang.Branch10, Motion=addition_8)  # -> Geometry, Transform
# CEM - Release 1.75
addition_9 = Addition(A=vec_8.Vector, B=Y)
move_12 = Move(Geometry=bang.Branch0, Motion=addition_9)  # -> Geometry, Transform
merge_5 = Merge(
    Data1=move_12.Geometry,
    Data2=move_10.Geometry,
    Data3=move_3.Geometry,
    Data4=move_5.Geometry,
    Data5=move_4.Geometry,
    Data6=move_6.Geometry,
    Data7=move.Geometry,
    Data8=move_7.Geometry,
    Data9=move_2.Geometry,
    Data10=move_8.Geometry,
    Data11=move_11.Geometry,
    Data12=move_9.Geometry)  # -> flatten(Result)

# ----
sort = SortList(Keys=sort_pt_2.Indices, ValuesA=merge_5)  # -> Keys, ValuesA

# ---- group: calculate equilibrium structure with CEM / set origin node coordinates (continued)
cem_origin_node_2_0 = CEM_Origin_Node_20(OriginNode=sort.ValuesA, OriginNodeID=cem_extract_topology_2_0.OriginNodeID)

# ---- group: calculate equilibrium structure with CEM (continued)
cem_calculate_structure_2_0 = CEM_Calculate_Structure_20(MarshallingSignalParameter=cem_build_topology_2_0, CPL=cem_constraint_plane_2_0, N=cem_origin_node_2_0)

# ---- group: visualize equilibrium structure
cem_extract_structure_2_0 = CEM_Extract_Structure_20(M=cem_calculate_structure_2_0)  # -> Nodes, NodesID, Trails, TrailsID, TrailsCol, TrailsMag, Deviations, DeviationsID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
pipe_scale = Slider(0.027, range=0.01..0.1)
minimum_thickness = Slider(0.18, range=0.1..0.5)
compression_penalty_factor = Slider(1.9, range=1..3)
abs = Absolute(Value=cem_extract_structure_2_0.TrailsMag)
abs_2 = Absolute(Value=cem_extract_structure_2_0.DeviationsMag)
smaller = SmallerThan(FirstNumber=cem_extract_structure_2_0.TrailsMag, SecondNumber=0)  # -> SmallerThan, OrEqualTo
smaller_2 = SmallerThan(FirstNumber=cem_extract_structure_2_0.DeviationsMag, SecondNumber=0)  # -> SmallerThan, OrEqualTo
subtraction_5 = Subtraction(A=1, B=smaller.SmallerThan)
multiplication = Multiplication(A=smaller.SmallerThan, B=compression_penalty_factor)
subtraction_6 = Subtraction(A=1, B=smaller_2.SmallerThan)
multiplication_2 = Multiplication(A=smaller_2.SmallerThan, B=compression_penalty_factor)
addition_10 = Addition(A=subtraction_5, B=multiplication)
addition_11 = Addition(A=subtraction_6, B=multiplication_2)
multiplication_3 = Multiplication(A=pipe_scale, B=addition_10, C=abs)
multiplication_4 = Multiplication(A=pipe_scale, B=addition_11, C=abs_2)
max = Maximum(A=multiplication_3, B=minimum_thickness)
max_2 = Maximum(A=multiplication_4, B=minimum_thickness)
pipe = Pipe(Curve=cem_extract_structure_2_0.Deviations, Radius=max_2, Caps=2)  # -> flatten(Pipe)
pipe_2 = Pipe(Curve=cem_extract_structure_2_0.Trails, Radius=max, Caps=2)  # -> flatten(Pipe)
merge_6 = Merge(Data1=pipe_2, Data2=pipe)
merge_7 = Merge(Data1=cem_extract_structure_2_0.TrailsCol, Data2=cem_extract_structure_2_0.DeviationsCol)
preview = CustomPreview(Geometry=merge_6, Material=merge_7)

# ---- group: compute load path
compression_penalty_factor_2 = Slider(1, range=1..3)
smaller_3 = SmallerThan(FirstNumber=cem_extract_structure_2_0.TrailsMag, SecondNumber=0)  # -> SmallerThan, OrEqualTo
smaller_4 = SmallerThan(FirstNumber=cem_extract_structure_2_0.DeviationsMag, SecondNumber=0)  # -> SmallerThan, OrEqualTo
subtraction_7 = Subtraction(A=1, B=smaller_4.SmallerThan)
multiplication_5 = Multiplication(A=smaller_4.SmallerThan, B=compression_penalty_factor_2)
subtraction_8 = Subtraction(A=1, B=smaller_3.SmallerThan)
multiplication_6 = Multiplication(A=smaller_3.SmallerThan, B=compression_penalty_factor_2)
addition_12 = Addition(A=subtraction_7, B=multiplication_5)
addition_13 = Addition(A=subtraction_8, B=multiplication_6)
len = Length(Curve=cem_extract_structure_2_0.Trails)
len_2 = Length(Curve=cem_extract_structure_2_0.Deviations)
multiplication_7 = Multiplication(A=len, B=abs, C=addition_13)
multiplication_8 = Multiplication(A=len_2, B=abs_2, C=addition_12)
ma = MassAddition(Input=multiplication_7)  # -> Result, PartialResults
ma_2 = MassAddition(Input=multiplication_8)  # -> Result, PartialResults
addition_14 = Addition(A=ma.Result, B=ma_2.Result)
load_path = Number(addition_14)
panel_5 = Panel(load_path)

# ---- group: compute maximum deck inclination
split = TextSplit(Text=cem_extract_structure_2_0.TrailsID, Separators="T")
item_2 = ListItem(List=split, Index=1, Wrap=True)  # -> flatten(Item)
larger = LargerThan(FirstNumber=item_2, SecondNumber=31)  # -> LargerThan, OrEqualTo
smaller_5 = SmallerThan(FirstNumber=item_2, SecondNumber=60)  # -> SmallerThan, OrEqualTo
and = GateAnd(A=larger.LargerThan, B=smaller_5.SmallerThan)
dispatch = Dispatch(List=cem_extract_structure_2_0.Trails, DispatchPattern=and)  # -> ListA, ListB
xz = XZPlane(Origin=Point(0, 0, 0))
X = UnitX(Factor=1)
X_2 = UnitX(Factor=-1)
angle = Angle(VectorA=dispatch.ListA, VectorB=X, Plane=xz)  # -> Angle, Reflex
angle_2 = Angle(VectorA=dispatch.ListA, VectorB=X_2, Plane=xz)  # -> Angle, Reflex
min = Minimum(A=angle_2.Angle, B=angle_2.Reflex)
min_2 = Minimum(A=angle.Angle, B=angle.Reflex)
min_3 = Minimum(A=min_2, B=min)
pi = Pi(Factor=1)
division = Division(A=min_3, B=pi)
multiplication_9 = Multiplication(A=division, B=180)
sort_2 = SortList(Keys=multiplication_9)  # -> Keys, ValuesA
item_3 = ListItem(List=sort_2.Keys, Index=-1, Wrap=True)
maximum_deck_inclination = Number(item_3)
panel_6 = Panel(maximum_deck_inclination)

# ---- group: assemble connectivity matrix
trails = Line(cem_extract_structure_2_0.Trails)
deviations = Line(cem_extract_structure_2_0.Deviations)
nodes = Point(cem_extract_structure_2_0.Nodes)
lines = Merge(Data1=trails, Data2=deviations)
eval = EvaluateCurve(Curve=lines, Parameter=0.5)  # -> Point, Tangent, Angle
cluster = Cluster(S=nodes, C=lines)  # -> S_2, out
lng = ListLength(List=eval.Point)
series = Series(Start=0, Step=1, Count=lng)
partition = PartitionList(List=cluster.out, Size=2)
panel_7 = Panel(partition)
tag = TextTag(Location=nodes, Text=cluster.S_2)
tag_2 = TextTag(Location=eval.Point, Text=series)

# ---- group: collect data
# # DESCRIPTION -> VARIABLE NAME (DIMENSION) SOURCE
# 
# # deviation force at main cable midspan -> cable_center_deviation_force (1) input
# # deviation force at deck midspan -> deck_center_deviation_force (1) input
# # force in hangars -> hangar_force (1) input
# # force in deviations inside deck -> deck_deviation_force (1) input
# # force in deviations between main cables -> cable_deviation_force (1) input
# # force in support towers -> tower_force (1) input
# # force in brace between support towers -> tower_brace_force (1) input
# # rise of the deck -> deck_rise (1) input
# # vertical distance between the deck and main cables at midspan -> cable_deck_midspan_distance (1) input
# # offset of tower base location in x direction/perpendicular to the river -> tower_base_x_offset (1) input
# # offset of tower base location in y direction/parallel -> tower_base_y_offset (1) input
# # offset of origin nodes at midspan to create a twist in the bridge -> twist_offset (1) input
# # number of nodes -> nN (1) output
# # number of trail edges -> nT (1) output
# # number of deviation edges -> nD (1) output
# # load X -> loadX (1) input
# # load Y -> loadY (1) input
# # load Z -> loadZ (1) input
# # nodes position X -> posX (nN) output
# # nodes position Y -> posX (nN) output
# # nodes position Z -> posX (nN) output
# # trail lenghts -> traLen (nT) output
# # trail magnitudes -> traMag (nT) output
# # deviation lenghts -> devLen (nD) output
# # deviation magnitudes -> devMag (nD) input
# # total load path -> load_path (1) output
# # highest inclination of the deck in degrees -> maximum deck inclination (1) output
merge_8 = Merge(
    Data1=cable_center_deviation_force,
    Data2=deck_center_deviation_force,
    Data3=hangar_force_2,
    Data4=deck_deviation_force,
    Data5=cable_deviation_force,
    Data6=tower_force,
    Data7=tower_brace_force,
    Data8=deck_rise,
    Data9=cable_deck_midspan_distance,
    Data10=tower_base_x_offset,
    Data11=tower_base_y_offset,
    Data12=twist_offset)
lng_2 = ListLength(List=cem_extract_structure_2_0.Nodes)
lng_3 = ListLength(List=cem_extract_structure_2_0.Trails)
lng_4 = ListLength(List=cem_extract_structure_2_0.Deviations)
pdecon_4 = Deconstruct(Point=cem_extract_structure_2_0.Nodes)  # -> XComponent, YComponent, ZComponent
len_3 = Length(Curve=cem_extract_structure_2_0.Trails)
len_4 = Length(Curve=cem_extract_structure_2_0.Deviations)
maximum_deck_inclination_2 = Number(maximum_deck_inclination)
filter_13 = StreamFilter(Gate=list, Stream0=merge_8, Stream1=merge, Stream2=merge_2)
load_path_2 = Number(load_path)
devmag = Number(cem_extract_structure_2_0.DeviationsMag)
nn = Integer(lng_2)
nt = Integer(lng_3)
nd = Integer(lng_4)
loadx = Number(panel)
loady = Number(panel_2)
loadz = Number(panel_3)
posx = Number(pdecon_4.XComponent)
posy = Number(pdecon_4.YComponent)
posz = Number(pdecon_4.ZComponent)
tralen = Number(len_3)
tramag = Number(cem_extract_structure_2_0.TrailsMag)
devlen = Number(len_4)

# ----
entwine = Entwine(
    Branch00=filter_13,
    Branch01=nn,
    Branch02=nt,
    Branch03=nd,
    Branch04=loadx,
    Branch05=loady,
    Branch06=loadz,
    Branch07=posx,
    Branch08=posy,
    Branch09=posz,
    Branch010=tralen,
    Branch011=tramag,
    Branch012=devlen,
    Branch013=devmag,
    Branch014=load_path_2,
    Branch015=maximum_deck_inclination_2,
    FlattenInputs=True)  # -> flatten(Result)

# ---- group: collect data (continued)
panel_8 = Panel(entwine)

# ---- group: record dataset
data_to_csv = Python3Script(x=entwine, file_name="240731_data_00_CEM.csv")  # inputs x: list; disabled
# ---------- data_to_csv: Python ----------
import os
import csv
import rhinoscriptsyntax as rs

with open(os.path.join(rs.DocumentPath(), 'Data' , file_name), "a") as csvfile1:
    if not None in x:
        if len(x) != 0:
            writer = csv.writer(csvfile1, delimiter=',')
            writer.writerow(x)
# ---------- end data_to_csv ----------
# Type here the floor heights
# CEM - Release 1.75
# If you use the library of CEM in a project, please refer to the CEM GitHub repository:
# 
# @Misc{cem2019,
# author = {Ohlbrock, Patrick Ole and D'Acunto, Pierluigi},
# title = {{CEM: Combinatorial Equilibrium Modeling}},
# year = {2019},
# note = {Release 1.75},
# url = { http://github.com/OleOhlbrock/CEM },
# }
# Type here the pattern for each slab (between 0 and 3, only integer) -
# Number of elements should be the same as in the floor height list
connectivity_matrix_to_csv = Python3Script(y=cluster.out, file_name="240731_data_00_branch-node_CEM.csv")  # inputs y: list; disabled
# ---------- connectivity_matrix_to_csv: Python ----------
import os
import csv
import rhinoscriptsyntax as rs

with open(os.path.join(rs.DocumentPath(), 'Data' , file_name), "w") as csvfile1:
    
    if not None in y:
        if len(y) != 0 :
            writer = csv.writer(csvfile1, delimiter=',')
            writer.writerow(y)
# ---------- end connectivity_matrix_to_csv ----------

# ==== cluster Cluster
S = ClusterInput()
C = ClusterInput()
lng = ListLength(List=S)
end = EndPoints(Curve=C)  # -> Start, End
panel = Panel(end.Start)
series = Series(Start=0, Step=1, Count=lng)
fsim = FindSimilarMember(Data=end.Start, Set=S)  # -> Hit, Index
python = GhPythonScript(x=S, y=end.Start, z=end.End)  # -> out, a; inputs x: list of Point3d, y: list of Point3d, z: list of Point3d
# ---------- python: Python ----------
__author__ = "bertagnf"
__version__ = "2021.04.13"

import rhinoscriptsyntax as rs

allp = x
startp = y
endp = z

for i in range(0, len(startp)):
    if startp[i] in allp and endp[i] in allp:
        print allp.index(startp[i])
        print allp.index(endp[i])
# ---------- end python ----------
fsim_2 = FindSimilarMember(Data=end.End, Set=S)  # -> Hit, Index
S_2 = ClusterOutput(series)
merge = Merge(Data1=graft(fsim.Index), Data2=graft(fsim_2.Index))  # -> flatten(Result)
panel_2 = Panel(python.out)
panel_3 = Panel(merge)
out = ClusterOutput(python.out)
